# Grasshopper definition EDGEMATCHER_190423.gh (Grasshopper 1.0.7)
# plug-ins: Anemone, Pufferfish, Human, Wombat, Heteroptera, HFTidyCanvas, treesloth01, EdiTree

curve = Curve([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])
curve_2 = Curve([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])
curve_3 = Curve([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])
curve_4 = Curve([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])
curve_5 = Curve([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])
curve_6 = Curve([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])
curve_7 = Curve([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])
curve_8 = Curve([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])
curve_9 = Curve([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])
curve_10 = Curve([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])
curve_11 = Curve([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])
curve_12 = Curve([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])
curve_13 = Curve([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])
curve_14 = Curve([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])
curve_15 = Curve([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])
curve_16 = Curve([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])
curve_17 = Curve([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])
curve_18 = Curve([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])
curve_19 = Curve([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])
curve_20 = Curve([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])
curve_21 = Curve([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])

curve_22 = Curve([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])
curve_23 = Curve([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])
curve_24 = Curve([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])
curve_25 = Curve([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])
curve_26 = Curve([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])
curve_27 = Curve([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])
_14 = Curve([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])
_4 = Curve([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])
curve_28 = Curve([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])

crv = Curve([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])
panel = Panel("""3
6
13
9""")

number_slider = Slider(9, range=0..100)
crv_2 = Curve([<curve referenced from the Rhino model> x5])

# ---- group: Target curves
crv_3 = Curve([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])

# ----
crv_4 = Curve(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)
crv_5 = Curve([<curve referenced from the Rhino model> x22])
yz = YZPlane(Origin=Point(0, 0, 0))
crv_6 = Curve([<curve referenced from the Rhino model> x29])
crv_7 = Curve(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)
crv_8 = Curve([<curve referenced from the Rhino model> x2])
double_curves = DataDescription([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])
single_curves = Curve([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])
crv_9 = Curve([<curve referenced from the Rhino model> x7])
item = ListItem(List=crv_2, Index=Slider(4, range=0..4), Wrap=True)
rotate = Rotate(Geometry=crv_6, Angle=1.570796327, Plane=yz)  # -> Geometry, Transform
explode = Explode(Curve=crv_8, Recursive=True)  # -> Segments, Vertices
divlength = DivideLength(Curve=crv_7, Length=Slider(6, range=0..10))  # -> Points, Tangents, Parameters
rotate_2 = Rotate(Geometry=crv_9, Angle=1.570796327, Plane=yz)  # -> Geometry, Transform
divlength_2 = DivideLength(Curve=crv_6, Length=Slider(5, range=0..10))  # -> Points, Tangents, Parameters
item_2 = ListItem(List=explode.Segments, Index=Slider(0, range=0..7), Wrap=True)
divlength_3 = DivideLength(Curve=rotate_2.Geometry, Length=Slider(5, range=0..10))  # -> Points, Tangents, Parameters

divide = DivideCurve(Curve=crv_4, Count=10, Kinks=False)  # -> Points, Tangents, Parameters
previewlw = CustomPreviewLineweights(Geometry=crv_4, Shader=ColourSwatch(SwatchColor=RGB(130, 255, 153)), Thickness=Slider(10, range=0..10), Absolute=False)
pdecon = Deconstruct(Point=divide.Points)  # -> XComponent, YComponent, ZComponent
ma = MassAddition(Input=pdecon.XComponent)  # -> flatten(Result), PartialResults
sort = SortList(Keys=ma.Result, ValuesA=crv_4)  # -> Keys, ValuesA
previewlw_2 = CustomPreviewLineweights(
    Geometry=sort.ValuesA,
    Shader=ColourSwatch(SwatchColor=RGB(255, 255, 255)),
    Thickness=Slider(5, range=0..10),
    Absolute=False)

cull = CullPattern(List=divlength.Points, CullPattern=[False, True])
col = Colour(RGB(179, 0, 255))
cull_2 = CullPattern(List=divlength_2.Points, CullPattern=[False, True])
swatch = ColourSwatch(SwatchColor=RGB(255, 255, 255))
col_2 = Colour(RGB(179, 0, 255))
partition = PartitionList(List=cull, Size=2)
swatch_2 = ColourSwatch(SwatchColor=RGB(255, 255, 255))
cull_3 = CullPattern(List=divlength_3.Points, CullPattern=[False, True])
partition_2 = PartitionList(List=cull_2, Size=2)
col_3 = Colour(RGB(179, 0, 255))
swatch_3 = ColourSwatch(SwatchColor=RGB(255, 255, 255))
pline = PolyLine(Vertices=partition, Closed=False)
partition_3 = PartitionList(List=cull_3, Size=2)
pline_2 = PolyLine(Vertices=partition_2, Closed=False)
swatch_4 = ColourSwatch(SwatchColor=RGB(148, 248, 255))
swatch_5 = ColourSwatch(SwatchColor=RGB(148, 248, 255))
pline_3 = PolyLine(Vertices=partition_3, Closed=False)
previewlw_3 = CustomPreviewLineweights(Geometry=pline, Shader=col, Thickness=Slider(7, range=0..10), Absolute=False)
crvdir = CurveDirectionDisplay(Curves=item_2, Color=RGB(255, 0, 0), Size=Slider(100, range=0..100))
previewlw_4 = CustomPreviewLineweights(
    Geometry=item_2,
    Shader={diffuse=RGB(255, 105, 180), emission=RGB(76, 32, 54), shine=0.5, specular=RGB(255, 255, 255), transparency=0},
    Thickness=Slider(10, range=0..10),
    Absolute=False)
gradient = Gradient(
    LowerLimit=0,
    UpperLimit=1,
    Parameter=pline_3,
    stops=[0: RGB(102, 255, 224), 0.116: RGB(64, 184, 146), 0.267: RGB(57, 181, 230), 0.547: RGB(91, 62, 181), 0.791: RGB(179, 0, 255)])
previewlw_5 = CustomPreviewLineweights(Geometry=pline_2, Shader=swatch_4, Thickness=Slider(6, range=0..10), Absolute=False)
previewlw_6 = CustomPreviewLineweights(Geometry=crv_5, Shader=swatch_4, Thickness=Slider(2, range=0..10), Absolute=False)
previewlw_7 = CustomPreviewLineweights(Geometry=pline_3, Shader=gradient, Thickness=Slider(3, range=0..10), Absolute=False)
panel_2 = Panel("4")
short_edge_max_difference = Slider(8, range=0..10)
item_3 = ListItem(List=sort.ValuesA, Index=0, Wrap=True)
cull_i = CullIndex(List=sort.ValuesA, Indices="0", Wrap=True)
overlap = Slider(-3, range=-10..0)
number_slider_2 = Slider(11, range=0..20)
toggle = BooleanToggle(False)
relay = Relay()
number_slider_3 = Slider(100, range=0..100)
X = UnitX(Factor=overlap)
subtraction = Subtraction(A="0", B=Slider(5, range=0..10))
number_slider_4 = Slider(20, range=0..20)
X_2 = UnitX(Factor=1)
subtraction_2 = Subtraction(A="0", B=Slider(5, range=0..10))
number_slider_5 = Slider(11, range=0..11)
number_slider_6 = Slider(5, range=0..20)
number_slider_7 = Slider(1, range=0..1)
number_slider_8 = Slider(3, range=0..10)
crv_10 = Curve([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])
series = Series(Start=0, Step=1, Count=number_slider_5)
series_2 = Series(Start=0, Step=1, Count=number_slider_5)
item_4 = ListItem(List=crv_10, Index=series_2, Wrap=True)
num = Number([481.8181208, 265.7230537, 177.267224, 382.4396069, 299.4336738, 182.3955784, 371.1783537, 339.1980562, 462.2005754, 323.1429644, 188.5525511, 299.5755577])
bnd = Bounds(Numbers=num)
extremums = MinMax(Number=num)  # -> Minimum, Maximum
num_2 = Number([3, 6, 8, 9])
col_4 = Colour(RGB(179, 0, 255))
previewlw_8 = CustomPreviewLineweights(Geometry=item_4, Shader=col_4, Thickness=Slider(6, range=0..10), Absolute=False)
number_slider_9 = Slider(3, range=0..3)
item_5 = ListItem(Index=0, Wrap=True)
subtree = SubTree()  # -> Path, SubTree
number_slider_10 = Slider(1000, range=0..5000)  # disabled
panel_3 = Panel("0")  # disabled
dom = ConstructDomain(DomainStart=panel_3, DomainEnd=number_slider_10)  # disabled
panel_4 = Panel("2")  # disabled
number_slider_11 = Slider(-38, range=-100..0)  # disabled
number_slider_12 = Slider(100, range=0..100)  # disabled
number_slider_13 = Slider(38, range=0..100)  # disabled
panel_5 = Panel("1000")  # disabled
number_slider_14 = Slider(100, range=0..100)  # disabled
neg = Negative(Value=number_slider_11)  # disabled
dom_2 = ConstructDomain(DomainStart=number_slider_11, DomainEnd=neg)  # disabled
number_slider_15 = Slider(0.376, range=0..1)  # disabled
number_slider_16 = Slider(14, range=0..100)  # disabled
number_slider_17 = Slider(247, range=0..250)  # disabled
number_slider_18 = Slider(2, range=0..10)  # disabled
number_slider_19 = Slider(6, range=0..10)  # disabled
pt = ConstructPoint(XCoordinate=0, YCoordinate=0, ZCoordinate=0)  # disabled
number_slider_20 = Slider(39, range=0..100)  # disabled
number_slider_21 = Slider(1000, range=0..1000)  # disabled
panel_6 = Panel("12")  # disabled
panel_7 = Panel("7")  # disabled
number_slider_22 = Slider(8, range=0..10)  # disabled
multiplication = Multiplication(A=number_slider_17, B=number_slider_18)  # disabled
division = Division(A=number_slider_16, B=number_slider_18)  # disabled
series_3 = Series(Start=0, Step=panel_6, Count=panel_7)  # disabled
Y = UnitY(Factor=number_slider_20)  # disabled
X_3 = UnitX(Factor=number_slider_17)  # disabled
pt_2 = Point(<point referenced from the Rhino model>)  # disabled
neg_2 = Negative(Value=Y)  # disabled
X_4 = UnitX(Factor=multiplication)  # disabled
Z = UnitZ(Factor=1)  # disabled
X_5 = UnitX(Factor=1)  # disabled
Y_2 = UnitY(Factor=1)  # disabled
panel_8 = Panel("7")  # disabled
sqgrid = Square(Plane=pt_2, Size=number_slider_17, ExtentX=number_slider_16, ExtentY=number_slider_19)  # -> flatten(Cells), Points; disabled
number_slider_23 = Slider(1253, range=0..10000)  # disabled
addition = Addition(A=X_3, B=neg_2)  # disabled
neg_3 = Negative(Value=X_5)  # disabled
neg_4 = Negative(Value=Y_2)  # disabled
number_slider_24 = Slider(3, range=0..10)  # disabled
move = Move(Geometry=pt_2, Motion=addition)  # -> Geometry, Transform; disabled
panel_9 = Panel("2")  # disabled
pt_3 = ConstructPoint(XCoordinate=0, YCoordinate=0, ZCoordinate=number_slider_23)  # disabled
line = LineSDL(Start=pt, Direction=[Y_2, X_5, Z], Length=number_slider_21)  # disabled
number_slider_25 = Slider(37, range=0..100)  # disabled
xy = XYPlane(Origin=pt_3)  # disabled
arrlinear = LinearArray(Geometry=move.Geometry, Direction=X_4, Count=division)  # -> Geometry, Transform; disabled
number_slider_26 = Slider(3, range=0..10)  # disabled
number_slider_27 = Slider(1, range=0..10)  # disabled
number_slider_28 = Slider(1, range=0..10)  # disabled
rectangle = Rectangle(Plane=arrlinear.Geometry, XSize=Domain(-110, 110), YSize=Domain(-5, 33), Radius=0)  # -> Rectangle, Length; disabled
swatch_6 = ColourSwatch(SwatchColor=RGB(255, 255, 255))  # disabled
swatch_7 = ColourSwatch(SwatchColor=RGB(255, 255, 255))  # disabled
number_slider_29 = Slider(5, range=0..10)  # disabled
number_slider_30 = Slider(28, range=0..100)  # disabled
swatch_8 = ColourSwatch(SwatchColor=RGB(255, 0, 0))  # disabled

stack = StackTrees(
    Data0=curve_2,
    Data1=curve_3,
    Data2=curve_20,
    Data3=curve_6,
    Data4=curve_7,
    Data5=curve_8,
    Data6=curve_17,
    Data7=curve_9,
    Data8=curve_10,
    Data9=curve_21,
    Data10=curve_11,
    Data11=curve,
    Data12=curve_14,
    Data13=curve_15,
    Data14=curve_16,
    Data15=curve_19,
    Reduce=True)
item_6 = ListItem(List=stack, Index=0, Wrap=True)
center = Center(Geometric=item_6)  # -> Center, Dimension
sqgrid_2 = Square(Plane=PlaneXY(0, 0, 0), Size=Slider(240, range=0..10000), ExtentX=5, ExtentY=5)  # -> Cells, Points
center_2 = Center(Geometric=sqgrid_2.Cells)  # -> simplify(Center), Dimension

tstat = TreeStatistics(Tree=stack)  # -> Paths, Length, Count
scale = Scale(Geometry=stack, Center=center.Center, Factor="0.1")  # -> Geometry, Transform

series_4 = Series(Start=0, Step=1, Count=tstat.Count)
item_7 = ListItem(List=flatten(center_2.Center), Index=series_4, Wrap=True)
orient = Orient(Geometry=scale.Geometry, Source=center.Center, Target=graft(item_7))  # -> Geometry, Transform

curve_29 = Curve([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])
curve_30 = Curve([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])
curve_31 = Curve([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])
curve_32 = Curve([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])
curve_33 = Curve([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])
curve_34 = Curve([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])
cull_i_2 = CullIndex(List=curve_29, Indices="0", Wrap=True)
scale_2 = Scale(Center=Point(0, 0, 0), Factor=Slider(0.1, range=0..0.1))  # -> Geometry, Transform
partition_4 = PartitionList(List=cull_i_2, Size="5")
partition_5 = PartitionList(List=scale_2.Geometry, Size="5")
item_8 = ListItem(List=cull_i_2, Index=Slider(3, range=0..10), Wrap=True)
cull_i_3 = CullIndex(List=orient.Geometry, Indices="0", Wrap=True)
len = Length(Curve=item_8)
panel_10 = Panel(len)
shift = ShiftList(List=cull_i_3, Shift=1, Wrap=True)
join_t = JoinCurvesWithTolerance(Curves=shift, Tolerance=Slider(27, range=0..100), Option=0)  # -> flatten(Curve)

index = ItemIndex(List=flatten(center.Center), Item=flatten(center.Center))
cull_i_4 = CullIndex(List=orient.Geometry, Indices=Slider(0, range=0..100), Wrap=True)
end = EndPoints(Curve=cull_i_4)  # -> Start, End
item_9 = ListItem(List=orient.Geometry, Index=Slider(0, range=0..4), Wrap=True)
x_plus_one = XPlusOne(NumberX=index)
vec2pt = Vector2Pt(PointA=end.Start, PointB=end.End, Unitize=False)  # -> Vector, Length
tag = TextTag3D(Location=flatten(center_2.Center), Text=flatten(x_plus_one), Size=Slider(69, range=0..100), Justification=1)
vdis = VectorDisplay(Anchor=end.Start, Vector=vec2pt.Vector)
preview = CustomPreview(Geometry=sqgrid_2.Cells, Material=ColourSwatch(SwatchColor=RGB(178, 115, 255)))
preview_2 = CustomPreview(Geometry=item_9, Material=ColourSwatch(SwatchColor=RGB(99, 255, 224)))
center_3 = Center(Geometric=join_t)  # -> Center, Dimension
replace = ReplaceItems(List=crv, Item=join_t, Indices=panel, Wrap=False)
item_10 = ListItem(List=join_t, Index=Slider(1, range=0..20), Wrap=True)
explode_2 = Explode(Curve=join_t, Recursive=True)  # -> Segments, Vertices
item_11 = ListItem(List=explode_2.Segments, Index=Slider(1, range=0..3), Wrap=True)
explode_3 = Explode(Curve=join_t, Recursive=True)  # -> Segments, Vertices
explode_4 = Explode(Curve=join_t, Recursive=True)  # -> Segments, Vertices
item_12 = ListItem(List=explode_3.Segments, Index=Slider(1, range=0..10), Wrap=True)  # -> flatten(Item)
item_13 = ListItem(List=explode_3.Segments, Index=Slider(3, range=0..10), Wrap=True)  # -> flatten(Item)
merge = Merge(Data1=item_12, Data2=item_13)

# ---- group: Overlap
short_edge_overlap = Slider(6, range=0..10)
end_2 = EndPoints(Curve=merge)  # -> Start, End
cir = Circle(Plane=end_2.Start, Radius=short_edge_overlap)  # -> graft(Circle)
cir_2 = Circle(Plane=end_2.End, Radius=short_edge_overlap)  # -> graft(Circle)
ccx = CurveCurve(CurveA=graft(merge), CurveB=[cir, cir_2])  # -> Points, ParamsA, ParamsB
trim = TrimTree(Tree=ccx.ParamsA, Depth=1)
shatter = Shatter(Curve=graft(merge), Parameters=trim)
item_14 = ListItem(List=shatter, Index="1", Wrap=True)  # -> flatten(Item)

# ----
lng = ListLength(List=join_t)
crv_11 = Curve(item_14)
split = SplitList(List=crv_11, Index=lng)  # -> graft(ListA), graft(ListB)
merge_2 = Merge(Data1=split.ListA, Data2=split.ListB)  # -> simplify(Result)
loop_start = LoopStart(
    Repeat=Slider(11, range=0..50),
    Trigger=Button(),
    TargetCurve=item_3,
    OffcutCurves=merge_2,
    Data_2="0",
    Data_3="0",
    FullOffcut=join_t,
    Data_8="0",
    Data_9="False")  # -> port, Counter, Data, Data_2, SelctedOffcuts, NullCheckNextTarget, Data_3, Data_4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
filter = StreamFilter(Gate=loop_start.NullCheckNextTarget, Stream0="0", Stream1="1")
addition_2 = Addition(A=loop_start.Data_3, B=filter)
bool = Boolean(loop_start.NullCheckNextTarget)
join = JoinCurves(Curves=loop_start.SelctedOffcuts, Preserve=False)  # -> flatten(Curves)
item_15 = ListItem(List=loop_start.Data, Index=0, Wrap=True)
item_16 = ListItem(List=loop_start.Data_2, Index="1", Wrap=True)  # -> flatten(Item)
item_17 = ListItem(List=loop_start.Data_2, Index=0, Wrap=True)  # -> flatten(Item)
relay_2 = DataDescription(loop_start.Data_4)
lng_2 = ListLength(List=item_17)
rotate_3 = Rotate(Geometry=item_16, Angle=degrees(Slider(180, range=0..1000)), Plane=PlaneXY(0, 0, 0))  # -> Geometry, Transform
rotate_4 = Rotate(Geometry=relay_2, Angle=degrees(Slider(180, range=0..1000)), Plane=PlaneXY(0, 0, 0))  # -> Geometry, Transform
x_minus_one = XMinusOne(NumberX=lng_2)
previous_contours = DataDescription(loop_start.Data_5)
previous_contours_2 = DataDescription(loop_start.Data_5)
clean = CleanTree(RemoveNulls=True, RemoveInvalid=True, RemoveEmpty=False, Tree=previous_contours)
clean_2 = CleanTree(RemoveNulls=True, RemoveInvalid=True, RemoveEmpty=False, Tree=previous_contours_2)
item_18 = ListItem(List=clean, Index="-1", Wrap=True)
item_19 = ListItem(List=clean_2, Index="-1", Wrap=True)
explode_5 = Explode(Curve=item_18, Recursive=True)  # -> Segments, Vertices
filter_2 = StreamFilter(Gate=loop_start._180CHECK, Stream0="2", Stream1="0")
filter_3 = StreamFilter(Gate=loop_start._180CHECK, Stream0="2", Stream1="0")
explode_6 = Explode(Curve=item_19, Recursive=True)  # -> Segments, Vertices
item_20 = ListItem(List=explode_5.Segments, Index=filter_2, Wrap=True)
item_21 = ListItem(List=explode_6.Segments, Index=filter_3, Wrap=True)
len_2 = Length(Curve=item_20)
len_3 = Length(Curve=item_21)
filter_4 = StreamFilter(Gate=loop_start.NullCheckNextTarget, Stream0=short_edge_max_difference, Stream1="100")
filter_5 = StreamFilter(Gate=loop_start.NullCheckNextTarget, Stream0=short_edge_max_difference, Stream1="100")
counter = Number(loop_start.Counter)
larger = LargerThan(FirstNumber=counter, SecondNumber="0")  # -> LargerThan, OrEqualTo
counter_2 = Number(loop_start.Counter)
larger_2 = LargerThan(FirstNumber=counter_2, SecondNumber="0")  # -> LargerThan, OrEqualTo
equals = Equality(FirstNumber=counter, SecondNumber="0")  # -> Equality, Inequality
equals_2 = Equality(FirstNumber=counter, SecondNumber="0")  # -> Equality, Inequality
selected_offcuts_d2 = DataDescription(loop_start.SelctedOffcuts)
relay_3 = DataDescription(loop_start.Data_6)
contour = DataDescription(loop_start.Data_5)
item_22 = ListItem(List=contour, Index=series, Wrap=True)
clean_3 = CleanTree(RemoveNulls=True, RemoveInvalid=True, RemoveEmpty=False, Tree=item_22)
len_4 = Length(Curve=clean_3)
crv_12 = Curve(relay_2)
len_5 = Length(Curve=crv_12)
gradient_2 = Gradient(
    LowerLimit=extremums.Minimum,
    UpperLimit=extremums.Maximum,
    Parameter=len_4,
    stops=[0: RGB(102, 255, 224), 0.116: RGB(64, 184, 146), 0.267: RGB(57, 181, 230), 0.547: RGB(91, 62, 181), 0.791: RGB(179, 0, 255)])
gradient_3 = Gradient(
    LowerLimit=extremums.Minimum,
    UpperLimit=extremums.Maximum,
    Parameter=len_5,
    stops=[0: RGB(102, 255, 224), 0.116: RGB(64, 184, 146), 0.267: RGB(57, 181, 230), 0.547: RGB(91, 62, 181), 0.791: RGB(179, 0, 255)])
previewlw_9 = CustomPreviewLineweights(Geometry=crv_12, Shader=gradient_3, Thickness=Slider(3, range=0..10), Absolute=False)
clean_4 = CleanTree(RemoveNulls=True, RemoveInvalid=True, RemoveEmpty=False, Tree=relay_3)
previewlw_10 = CustomPreviewLineweights(Geometry=item_22, Shader=gradient_2, Thickness=Slider(3, range=0..10), Absolute=False)
clean_5 = CleanTree(RemoveNulls=True, RemoveInvalid=True, RemoveEmpty=False, Tree=contour)
clean_6 = CleanTree(RemoveNulls=True, RemoveInvalid=True, RemoveEmpty=False, Tree=selected_offcuts_d2)
clean_7 = CleanTree(RemoveNulls=True, RemoveInvalid=True, RemoveEmpty=False, Tree=loop_start.Data_7)
crv_13 = Curve(join_t)
explode_7 = Explode(Curve=crv_13, Recursive=True)  # -> Segments, Vertices
item_23 = ListItem(List=explode_7.Segments, Index=Slider(1, range=0..3), Wrap=True)
len_6 = Length(Curve=flatten(item_23))
original_curves = Curve(merge)
center_4 = Center(Geometric=crv_13)  # -> flatten(Center), Dimension

crv_14 = Curve(loop_start.Data_6)
panel_11 = Panel("25")
swatch_9 = ColourSwatch(SwatchColor=RGB(148, 248, 255))

clean_8 = CleanTree(RemoveNulls=True, RemoveInvalid=True, RemoveEmpty=False, Tree=crv_14)
lng_3 = ListLength(List=clean_8)
filter_6 = StreamFilter(Gate=loop_start.Data_8, Stream0=loop_start.NextCurveIndex, Stream1=lng_3)
x_minus_one_2 = XMinusOne(NumberX=filter_6)

rec = DataRecorder(x_minus_one_2, DataLimit=-10, RecordData=False)
pt_4 = ConstructPoint(XCoordinate=rec, YCoordinate=0, ZCoordinate=0)
cullpt = CullDuplicates(Points=pt_4, Tolerance=0.1, CullMode=3)  # -> Points, Indices, Valence
pdecon_2 = Deconstruct(Point=cullpt.Points)  # -> XComponent, YComponent, ZComponent
cull_i_5 = CullIndex(List=pdecon_2.XComponent, Indices="0", Wrap=True)

split_2 = SplitList(List=clean_8, Index=x_minus_one_2)  # -> ListA, ListB

join_t_2 = JoinCurvesWithTolerance(Curves=split_2.ListB, Tolerance=Slider(27, range=0..29), Option=0)
reb = RebuildCurve(Curve=join_t_2, Count=Slider(20, range=0..100), Tangents=False)
divide_2 = DivideCurve(Curve=reb, Count=10, Kinks=False)  # -> Points, Tangents, Parameters
pdecon_3 = Deconstruct(Point=divide_2.Points)  # -> XComponent, YComponent, ZComponent
ma_2 = MassAddition(Input=pdecon_3.XComponent)  # -> flatten(Result), PartialResults
sort_2 = SortList(Keys=ma_2.Result, ValuesA=reb)  # -> Keys, ValuesA
item_24 = ListItem(List=sort_2.ValuesA, Index="-1", Wrap=True)

previewlw_11 = CustomPreviewLineweights(Geometry=join, Shader=swatch_9, Thickness=Slider(6, range=0..10), Absolute=False)
previewlw_12 = CustomPreviewLineweights(Geometry=item_24, Shader=swatch_9, Thickness=Slider(5, range=0..10), Absolute=False)

filter_7 = StreamFilter(Gate=loop_start.NullCheckNextTarget, Stream0=item_15, Stream1=item_24)
crv_15 = Curve(filter_7)

crv_16 = Curve(item_17)
target = Curve(crv_15)
crv_17 = Curve(rotate_3.Geometry)
crv_18 = Curve(rotate_4.Geometry)
crv_19 = Curve(relay_2)

# ---- group: Orient offcut curves to target curve
merge_3 = Merge(Data1=crv_16, Data2=crv_17)
merge_4 = Merge(Data1=crv_19, Data2=crv_18)
end_3 = EndPoints(Curve=merge_3)  # -> Start, End
end_4 = EndPoints(Curve=target)  # -> Start, End
vec2pt_2 = Vector2Pt(PointA=end_4.Start, PointB=end_4.End, Unitize=False)  # -> Vector, Length
vec2pt_3 = Vector2Pt(PointA=end_3.Start, PointB=end_4.Start, Unitize=False)  # -> Vector, Length
vec2pt_4 = Vector2Pt(PointA=end_3.Start, PointB=end_3.End, Unitize=False)  # -> Vector, Length
move_2 = Move(Geometry=merge_3, Motion=vec2pt_3.Vector)  # -> Geometry, Transform
dist = Distance(PointA=end_3.Start, PointB=end_3.End)
end_5 = EndPoints(Curve=move_2.Geometry)  # -> Start, End
pt_5 = Point(end_5.Start)
sph = Sphere(Base=end_5.Start, Radius=dist)
bcx = BrepCurve(Brep=sph, Curve=target)  # -> Curves, simplify(flatten(Points))
transform = Transform(Geometry=merge_4, Transform=move_2.Transform)
null = NullItem(Item=bcx.Points)  # -> NullFlags, flatten(InvalidFlags), Description
vec2pt_5 = Vector2Pt(PointA=end_5.Start, PointB=bcx.Points, Unitize=False)  # -> Vector, Length
mm = MassMultiplication(Input=null.InvalidFlags)  # -> Result, PartialResults
crv_cp = CurveClosestPoint(Point=bcx.Points, Curve=target)  # -> Point, Parameter, Distance
filter_8 = StreamFilter(Gate=mm.Result, Stream0=vec2pt_5.Vector, Stream1=vec2pt_2.Vector)
shatter_2 = Shatter(Curve=graft(target), Parameters=graft(crv_cp.Parameter))  # -> simplify(Segments)
rotate_5 = RotateDirection(Geometry=move_2.Geometry, Center=end_5.Start, From=vec2pt_4.Vector, To=filter_8)  # -> Geometry, Transform
item_25 = ListItem(List=shatter_2, Index=0, Wrap=True)
transform_2 = Transform(Geometry=transform, Transform=rotate_5.Transform)

# ----
loop_start_2 = LoopStart(
    Repeat=x_minus_one,
    Trigger=Button(),
    TargetCurve=crv_15,
    CurvesLeft=item_17,
    ContourLeft=relay_2,
    OffcutCurvesRight=item_16,
    CurveRight180=rotate_3.Geometry,
    Controur180=rotate_4.Geometry)  # -> port, Counter, Data, Data_2, Data_3, Data_4, Contour, Data_5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
right = ListItem(List=loop_start_2.Data_7, Index=0, Wrap=True)
contour_left = ListItem(List=loop_start_2.Contour, Index=0, Wrap=True)
contour_right = ListItem(List=loop_start_2.Data_8, Index=0, Wrap=True)
left = ListItem(List=loop_start_2.Data_2, Index=0, Wrap=True)
cull_i_6 = CullIndex(List=loop_start_2.Data_7, Indices=0, Wrap=True)
cull_i_7 = CullIndex(List=loop_start_2.Data_8, Indices=0, Wrap=True)
cull_i_8 = CullIndex(List=loop_start_2.Data_2, Indices=0, Wrap=True)
cull_i_9 = CullIndex(List=loop_start_2.Contour, Indices=0, Wrap=True)
end_6 = EndPoints(Curve=loop_start_2.Data)  # -> Start, End
end_7 = EndPoints(Curve=left)  # -> Start, End
end_8 = EndPoints(Curve=right)  # -> Start, End
vec2pt_6 = Vector2Pt(PointA=end_8.Start, PointB=end_6.Start, Unitize=False)  # -> Vector, Length
vec2pt_7 = Vector2Pt(PointA=end_7.Start, PointB=end_6.Start, Unitize=False)  # -> Vector, Length
move_3 = Move(Geometry=left, Motion=vec2pt_7.Vector)  # -> Geometry, Transform
move_4 = Move(Geometry=right, Motion=vec2pt_6.Vector)  # -> Geometry, Transform
move_5 = Move(Geometry=contour_right, Motion=vec2pt_6.Vector)  # -> Geometry, Transform
move_6 = Move(Geometry=contour_left, Motion=vec2pt_7.Vector)  # -> Geometry, Transform
end_9 = EndPoints(Curve=move_3.Geometry)  # -> Start, End
end_10 = EndPoints(Curve=move_4.Geometry)  # -> Start, End
dist_2 = Distance(PointA=end_10.Start, PointB=end_10.End)
dist_3 = Distance(PointA=end_9.Start, PointB=end_9.End)
sph_2 = Sphere(Base=end_10.Start, Radius=dist_2)
sph_3 = Sphere(Base=end_9.Start, Radius=dist_3)
preview_3 = CustomPreview(Geometry=sph_3, Material=ColourSwatch(SwatchColor=RGBA(255, 255, 255, 42)))
bcx_2 = BrepCurve(Brep=sph_2, Curve=loop_start_2.Data)  # -> Curves, Points
bcx_3 = BrepCurve(Brep=sph_3, Curve=loop_start_2.Data)  # -> Curves, Points
item_26 = ListItem(List=bcx_2.Points, Index=0, Wrap=True)
item_27 = ListItem(List=bcx_3.Points, Index=0, Wrap=True)
vec2pt_8 = Vector2Pt(PointA=end_10.Start, PointB=item_26, Unitize=False)  # -> Vector, Length
vec2pt_9 = Vector2Pt(PointA=end_10.Start, PointB=end_10.End, Unitize=False)  # -> Vector, Length
vec2pt_10 = Vector2Pt(PointA=end_9.Start, PointB=end_9.End, Unitize=False)  # -> Vector, Length
vec2pt_11 = Vector2Pt(PointA=end_9.Start, PointB=item_27, Unitize=False)  # -> Vector, Length
crv_cp_2 = CurveClosestPoint(Point=item_27, Curve=loop_start_2.Data)  # -> Point, Parameter, Distance
rotate_6 = RotateDirection(Geometry=move_5.Geometry, Center=end_10.Start, From=vec2pt_9.Vector, To=vec2pt_8.Vector)  # -> Geometry, Transform
rotate_7 = RotateDirection(Geometry=move_4.Geometry, Center=end_10.Start, From=vec2pt_9.Vector, To=vec2pt_8.Vector)  # -> Geometry, Transform
rotate_8 = RotateDirection(Geometry=move_3.Geometry, Center=end_9.Start, From=vec2pt_10.Vector, To=vec2pt_11.Vector)  # -> Geometry, Transform
rotate_9 = RotateDirection(Geometry=move_6.Geometry, Center=end_9.Start, From=vec2pt_10.Vector, To=vec2pt_11.Vector)  # -> Geometry, Transform

# ---- group: Find the best fit
divide_3 = DivideCurve(Curve=flatten(item_25), Count=number_slider_3, Kinks=False)  # -> Points, Tangents, Parameters
divide_4 = DivideCurve(Curve=rotate_5.Geometry, Count=number_slider_3, Kinks=False)  # -> Points, Tangents, Parameters
angle = Angle(VectorA=divide_3.Tangents, VectorB=divide_4.Tangents)  # -> Angle, Reflex
dist_4 = Distance(PointA=divide_3.Points, PointB=divide_4.Points)
ma_3 = MassAddition(Input=dist_4)  # -> flatten(Result), PartialResults
ma_4 = MassAddition(Input=angle.Angle)  # -> flatten(Result), PartialResults
bnd_2 = Bounds(Numbers=ma_4.Result)
bnd_3 = Bounds(Numbers=ma_3.Result)
remap = RemapNumbers(Value=ma_3.Result, Source=bnd_3, Target=Domain(0, 1))  # -> Mapped, Clipped
remap_2 = RemapNumbers(Value=ma_4.Result, Source=bnd_2, Target=Domain(0, 1))  # -> Mapped, Clipped
addition_3 = Addition(A=remap_2.Mapped, B=remap.Mapped)
index_2 = ItemIndex(List=addition_3, Item=addition_3)
sort_3 = SortList(Keys=addition_3, ValuesA=index_2)  # -> Keys, ValuesA
number_slider_31 = Slider(5, range=0..10)
index_3 = ItemIndex(List=ma_3.Result, Item=ma_3.Result)
sort_4 = SortList(Keys=ma_3.Result, ValuesA=index_3)  # -> Keys, ValuesA
addition_4 = Addition(A=loop_start.Counter)
split_3 = SplitList(List=sort_3.ValuesA, Index=number_slider_31)  # -> ListA, ListB
random = Random(Range=number_slider_31, Number=1, Seed=addition_4)
item_28 = ListItem(List=sort_4.ValuesA, Index=0, Wrap=True)
item_29 = ListItem(List=split_3.ListA, Index=random, Wrap=True)
item_30 = ListItem(List=rotate_5.Geometry, Index=item_28, Wrap=True)

# ----
crv_cp_3 = CurveClosestPoint(Point=item_26, Curve=loop_start_2.Data)  # -> Point, Parameter, Distance
explode_8 = Explode(Curve=rotate_9.Geometry, Recursive=True)  # -> Segments, Vertices
item_31 = ListItem(List=explode_8.Segments, Index="3", Wrap=True)
move_7 = Move(Geometry=item_31, Motion=X)  # -> Geometry, Transform
ext = ExtendCurve(Curve=move_7.Geometry, Type=0, Start="0", End=subtraction)
flip = FlipCurve(Curve=ext)  # -> Curve, Flag
loop_end = LoopEnd(
    port=loop_start_2.port,
    Exit=False,
    TargetCurve=loop_start_2.Data,
    Data=cull_i_8,
    TParamLeft=crv_cp_2.Parameter,
    Data_2=rotate_8.Geometry,
    Data_3=cull_i_9,
    ConL=rotate_9.Geometry,
    Right=flip.Curve,
    Data_4=cull_i_6,
    Data_5=cull_i_7,
    Left180=rotate_7.Geometry,
    Contour180=rotate_6.Geometry,
    TParam180=crv_cp_3.Parameter,
    TimeOutVal=0,
    pausedState=False,
    state="Last & Record")  # -> flatten(TargetCurve), Data, flatten(TParamLeft), flatten(Data_2), Data_3, OrienetedConL, OrientedRight, Data_4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

# ---- group: Checks if curve is flipped 180
lng_4 = ListLength(List=sort_3.ValuesA)
division_2 = Division(A=lng_4, B="2")
larger_3 = LargerThan(FirstNumber=item_29, SecondNumber=division_2)  # -> LargerThan, OrEqualTo

# ----
flatten = FlattenTree(Tree=loop_end.Data_7, Path="{0}")

explode_9 = Explode(Curve=flatten, Recursive=True)  # -> Segments, Vertices
item_32 = ListItem(List=explode_9.Segments, Index="1", Wrap=True)
X_6 = UnitX(Factor=overlap)
move_8 = Move(Geometry=item_32, Motion=X_6)  # -> Geometry, Transform
subtraction_3 = Subtraction(A="0", B=Slider(5, range=0..10))
ext_2 = ExtendCurve(Curve=move_8.Geometry, Type=0, Start="0", End=subtraction_3)
flip_2 = FlipCurve(Curve=ext_2)  # -> Curve, Flag

len_7 = Length(Curve=ext_2)
panel_12 = Panel(len_7)
flatten_2 = FlattenTree(Tree=loop_end.Data_8, Path="{0}")
flatten_3 = FlattenTree(Tree=loop_end.Data_6, Path="{0}")
flatten_4 = FlattenTree(Tree=loop_end.OrientedRight, Path="{0}")
# Contour normal
flatten_5 = FlattenTree(Tree=loop_end.OrienetedConL, Path="{0}")
filter_9 = StreamFilter(Gate=larger_3.OrEqualTo, Stream0="0", Stream1=division_2)
# T-param
flatten_6 = FlattenTree(Tree=loop_end.TParamLeft, Path="{0}")
# Left
flatten_7 = FlattenTree(Tree=loop_end.Data_2, Path="{0}")
# Right
clean_9 = CleanTree(RemoveNulls=True, RemoveInvalid=True, RemoveEmpty=False, Tree=flatten_4)
item_33 = ListItem(List=loop_end.TargetCurve, Index=0, Wrap=True)
clean_10 = CleanTree(RemoveNulls=True, RemoveInvalid=True, RemoveEmpty=False, Tree=flatten_5)
# T-param 180
item_34 = ListItem(List=loop_end.TargetCurve, Index=0, Wrap=True)
clean_11 = CleanTree(RemoveNulls=True, RemoveInvalid=True, RemoveEmpty=False, Tree=flatten_2)
# 180 Left
clean_12 = CleanTree(RemoveNulls=True, RemoveInvalid=True, RemoveEmpty=False, Tree=flatten_3)
# 180 Contour
clean_13 = CleanTree(RemoveNulls=True, RemoveInvalid=True, RemoveEmpty=False, Tree=flatten)
# 180 Right
flatten_8 = FlattenTree(Tree=flip_2.Curve, Path="{0}")
flatten_9 = FlattenTree(Tree=loop_end.Data_6, Path="{0}")

# ---- group: Index of selected offcut
subtraction_4 = Subtraction(A=item_29, B=filter_9)

# ----
# Indexes
flatten_10 = FlattenTree(Tree=loop_end.Data_2, Path="{0}")

# ---- group: Best fitting curve
item_35 = ListItem(List=rotate_5.Geometry, Index=item_29, Wrap=True)

# ---- group: Best fitting contour
item_36 = ListItem(List=transform_2, Index=item_29, Wrap=True)

# ---- group: t-param on target curve
item_37 = ListItem(List=crv_cp.Parameter, Index=subtraction_4, Wrap=True)

# ----
expression = Expression(x=subtraction_4, Expression="Format(\"{{{0}}}\", x)")
explode_10 = Explode(Curve=item_36, Recursive=True)  # -> Segments, Vertices
filter_10 = StreamFilter(Gate=larger_3.OrEqualTo, Stream0="3", Stream1="1")
shatter_3 = Shatter(Curve=graft(item_33), Parameters=graft(flatten_6))
shatter_4 = Shatter(Curve=target, Parameters=item_37)
explode_11 = Explode(Curve=flatten_5, Recursive=True)  # -> Segments, Vertices
explode_12 = Explode(Curve=flatten, Recursive=True)  # -> Segments, Vertices
item_38 = ListItem(List=explode_10.Segments, Index=filter_10, Wrap=True)
item_39 = ListItem(List=shatter_3, Index=0, Wrap=True)  # -> simplify(flatten(Item))
shatter_5 = Shatter(Curve=graft(item_34), Parameters=graft(flatten_2))
item_40 = ListItem(List=shatter_5, Index=0, Wrap=True)  # -> simplify(flatten(Item))
divide_5 = DivideCurve(Curve=item_38, Count=10, Kinks=False)  # -> Points, Tangents, Parameters
divide_6 = DivideCurve(Curve=item_35, Count=10, Kinks=False)  # -> Points, Tangents, Parameters
item_41 = ListItem(List=explode_11.Segments, Index=Slider(0, range=0..100), Wrap=True)
item_42 = ListItem(List=explode_12.Segments, Index=Slider(2, range=0..100), Wrap=True)
vec2pt_12 = Vector2Pt(PointA=divide_5.Points, PointB=divide_6.Points, Unitize=False)  # -> Vector, Length
len_8 = Length(Curve=item_41)
len_9 = Length(Curve=item_42)

split_4 = SplitTree(Data=loop_start.Data_2, Masks=flatten(expression))  # -> Positive, Negative
renumber = RenumberPaths(Data=split_4.Negative)

ma_5 = MassAddition(Input=vec2pt_12.Vector)  # -> Result, PartialResults

# ---- group: Target curve segment
item_43 = ListItem(List=shatter_4, Index="1", Wrap=True)

# ----
null_2 = NullItem(Item=item_35)  # -> NullFlags, InvalidFlags, Description
cull_i_10 = CullIndex(List=loop_start.Data_4, Indices=subtraction_4, Wrap=True)
index_4 = ItemIndex(List=flatten_10, Item=flatten_10)
subtraction_5 = Subtraction(A=len_2, B=len_8)  # -> flatten(Result)
subtraction_6 = Subtraction(A=len_3, B=flatten(len_9))  # -> flatten(Result)
multiplication_2 = Multiplication(A=ma_5.Result, B=Slider(0.02, range=0..1))
clean_14 = CleanTree(RemoveNulls=True, RemoveInvalid=True, RemoveEmpty=False, Tree=index_4)
index_5 = ItemIndex(List=flatten_9, Item=flatten_9)
abs = Absolute(Value=subtraction_5)
abs_2 = Absolute(Value=subtraction_6)
move_9 = Move(Geometry=item_38, Motion=multiplication_2)  # -> Geometry, Transform
larger_4 = LargerThan(FirstNumber=abs, SecondNumber=filter_4)  # -> LargerThan, OrEqualTo
clean_15 = CleanTree(RemoveNulls=True, RemoveInvalid=True, RemoveEmpty=False, Tree=index_5)
larger_5 = LargerThan(FirstNumber=abs_2, SecondNumber=filter_5)  # -> LargerThan, OrEqualTo
filter_11 = StreamFilter(Gate=null_2.NullFlags, Stream0=renumber, Stream1=loop_start.Data_2)
filter_12 = StreamFilter(Gate=null_2.NullFlags, Stream0=cull_i_10, Stream1=loop_start.Data_4)
dispatch = Dispatch(List=flatten(flatten_5), DispatchPattern=larger_4.LargerThan)  # -> ListA, ListB
ext_3 = ExtendCurve(Curve=move_9.Geometry, Type=0, Start="0", End=subtraction_2)
dispatch_2 = Dispatch(List=flatten(item_39), DispatchPattern=larger_4.LargerThan)  # -> ListA, ListB
dispatch_3 = Dispatch(List=flatten(index_4), DispatchPattern=larger_4.LargerThan)  # -> ListA, ListB
dispatch_4 = Dispatch(List=flatten(flatten_7), DispatchPattern=larger_4.LargerThan)  # -> ListA, ListB
crv_20 = Curve(dispatch.ListB)
filter_13 = StreamFilter(Gate=0, Stream0=ext_3, Stream1=move_9.Geometry)
crv_21 = Curve(dispatch_4.ListB)
dispatch_5 = Dispatch(List=flatten(item_40), DispatchPattern=larger_5.LargerThan)  # -> ListA, ListB
dispatch_6 = Dispatch(List=flatten(flatten_3), DispatchPattern=larger_5.LargerThan)  # -> ListA, ListB
dispatch_7 = Dispatch(List=flatten(index_5), DispatchPattern=larger_5.LargerThan)  # -> ListA, ListB
item_44 = ListItem(List=flatten_5, Index="-1", Wrap=True)

# ---- group: Opposite edge for next target curve
flip_3 = FlipCurve(Curve=ext_3)  # -> Curve, Flag

# ----
panel_13 = Panel(index_5)
filter_14 = StreamFilter(Gate=larger.LargerThan, Stream0=item_39, Stream1=dispatch_2.ListB)
filter_15 = StreamFilter(Gate=larger.LargerThan, Stream0=flatten_7, Stream1=dispatch_4.ListB)
panel_14 = Panel(index_4)
filter_16 = StreamFilter(Gate=larger.LargerThan, Stream0=index_4, Stream1=dispatch_3.ListB)
filter_17 = StreamFilter(Gate=larger_2.LargerThan, Stream0=index_5, Stream1=dispatch_7.ListB)
filter_18 = StreamFilter(Gate=larger_2.LargerThan, Stream0=item_40, Stream1=dispatch_5.ListB)
filter_19 = StreamFilter(Gate=larger_2.LargerThan, Stream0=flatten_3, Stream1=dispatch_6.ListB)

divide_7 = DivideCurve(Curve=filter_14, Count="35", Kinks=False)  # -> Points, simplify(Tangents), Parameters
divide_8 = DivideCurve(Curve=filter_15, Count="35", Kinks=False)  # -> Points, Tangents, Parameters
angle_2 = Angle(VectorA=divide_7.Tangents, VectorB=divide_8.Tangents)  # -> simplify(Angle), Reflex
ma_6 = MassAddition(Input=angle_2.Angle)  # -> flatten(Result), PartialResults

divide_9 = DivideCurve(Curve=filter_18, Count="35", Kinks=False)  # -> Points, simplify(Tangents), Parameters
divide_10 = DivideCurve(Curve=filter_19, Count="35", Kinks=False)  # -> Points, Tangents, Parameters
ma_7 = MassAddition(Input=ma_6.Result)  # -> Result, PartialResults
clean_16 = CleanTree(RemoveNulls=True, RemoveInvalid=True, RemoveEmpty=False, Tree=ma_6.Result)
angle_3 = Angle(VectorA=divide_9.Tangents, VectorB=divide_10.Tangents)  # -> simplify(Angle), Reflex
clean_17 = CleanTree(RemoveNulls=True, RemoveInvalid=True, RemoveEmpty=False, Tree=filter_16)
ma_8 = MassAddition(Input=angle_3.Angle)  # -> flatten(Result), PartialResults
clean_18 = CleanTree(RemoveNulls=True, RemoveInvalid=True, RemoveEmpty=False, Tree=ma_8.Result)
ma_9 = MassAddition(Input=ma_8.Result)  # -> Result, PartialResults
sort_5 = SortList(Keys=clean_16, ValuesA=clean_17)  # -> Keys, ValuesA
clean_19 = CleanTree(RemoveNulls=True, RemoveInvalid=True, RemoveEmpty=False, Tree=filter_17)
index_6 = ItemIndex(List=ma_6.Result, Item=ma_6.Result)
null_3 = NullItem(Item=ma_7.Result)  # -> NullFlags, InvalidFlags, Description
null_4 = NullItem(Item=ma_9.Result)  # -> NullFlags, InvalidFlags, Description
item_45 = ListItem(List=null_3.NullFlags, Index=0, Wrap=True)
sort_6 = SortList(Keys=clean_18, ValuesA=clean_19)  # -> Keys, ValuesA
item_46 = ListItem(List=null_4.NullFlags, Index=0, Wrap=True)
filter_20 = StreamFilter(Gate=item_45, Stream0=sort_5.Keys, Stream1="0")
item_47 = ListItem(List=filter_20, Index=0, Wrap=True)

equals_3 = Equality(FirstNumber=item_47, SecondNumber="0")  # -> Equality, Inequality

filter_21 = StreamFilter(Gate=item_45, Stream0=sort_5.ValuesA, Stream1="0")
selected_plank_index = ListItem(List=filter_21, Index=0, Wrap=True)
filter_22 = StreamFilter(Gate=equals.Equality, Stream0=selected_plank_index, Stream1=number_slider_2)
lng_5 = ListLength(List=crv_14)
subtraction_7 = Subtraction(A=lng_5, B=number_slider_5)
expression_2 = Expression(x=filter_22, Expression="Format(\"{{{0}}}\", x)")
t_param = ListItem(List=flatten_6, Index=filter_22, Wrap=True)
contour_2 = ListItem(List=flatten_5, Index=filter_22, Wrap=True)
left_2 = ListItem(List=flatten_7, Index=filter_22, Wrap=True)
right_2 = ListItem(List=flatten_4, Index=filter_22, Wrap=True)
filter_23 = StreamFilter(Gate=item_46, Stream0=sort_6.ValuesA, Stream1="0")
selected_plank_index_2 = ListItem(List=filter_23, Index=0, Wrap=True)
filter_24 = StreamFilter(Gate=equals_2.Equality, Stream0=selected_plank_index_2, Stream1=number_slider_2)
filter_25 = StreamFilter(Gate=equals_3.Equality, Stream0=item_47, Stream1="1000")
filter_26 = StreamFilter(Gate=item_46, Stream0=sort_6.Keys, Stream1="0")
item_48 = ListItem(List=filter_26, Index=0, Wrap=True)
equals_4 = Equality(FirstNumber=item_48, SecondNumber="0")  # -> Equality, Inequality
filter_27 = StreamFilter(Gate=equals_4.Equality, Stream0=item_48, Stream1="1000")
expression_3 = Expression(x=filter_24, Expression="Format(\"{{{0}}}\", x)")
crv_22 = Curve(crv_14)
series_5 = Series(Start=0, Step=0, Count=subtraction_7)
larger_6 = LargerThan(FirstNumber=filter_25, SecondNumber=filter_27)  # -> LargerThan, OrEqualTo
item_49 = ListItem(List=crv_14, Index=series_2, Wrap=True)
t_param_2 = ListItem(List=flatten_2, Index=filter_24, Wrap=True)
left_3 = ListItem(List=flatten_3, Index=filter_24, Wrap=True)
right_3 = ListItem(List=flatten_8, Index=filter_24, Wrap=True)
contour_3 = ListItem(List=flatten, Index=filter_24, Wrap=True)
ins = InsertItems(List=item_49, Item=series_5, Indices=number_slider_5, Wrap=True)
split_multi = SplitListMulti(List=ins, Index=num_2)
# T-param
filter_28 = StreamFilter(Gate=larger_6.LargerThan, Stream0=t_param, Stream1=t_param_2)
filter_29 = StreamFilter(Gate=larger_6.LargerThan, Stream0=expression_2, Stream1=expression_3)
# Contour
filter_30 = StreamFilter(Gate=larger_6.LargerThan, Stream0=contour_2, Stream1=contour_3)
filter_31 = StreamFilter(Gate=larger_6.LargerThan, Stream0=filter_22, Stream1=filter_24)
# Left
filter_32 = StreamFilter(Gate=larger_6.LargerThan, Stream0=left_2, Stream1=left_3)
# Right
filter_33 = StreamFilter(Gate=larger_6.LargerThan, Stream0=right_2, Stream1=right_3)
join_t_3 = JoinCurvesWithTolerance(Curves=split_multi, Tolerance=Slider(13, range=0..29), Option=0)
reb_2 = RebuildCurve(Curve=join_t_3, Count=Slider(20, range=0..100), Tangents=False)
previewlw_13 = CustomPreviewLineweights(Geometry=reb_2, Shader=ColourSwatch(SwatchColor=RGB(148, 248, 255)), Thickness=Slider(4, range=0..10), Absolute=False)
split_5 = SplitTree(Data=loop_start.Data_2, Masks=flatten(filter_29))  # -> Positive, Negative
null_5 = NullItem(Item=filter_32)  # -> NullFlags, InvalidFlags, Description
cull_i_11 = CullIndex(List=loop_start.Data_4, Indices=filter_31, Wrap=True)
shatter_6 = Shatter(Curve=crv_15, Parameters=filter_28)
renumber_2 = RenumberPaths(Data=split_5.Negative)
clean_20 = CleanTree(RemoveNulls=True, RemoveInvalid=True, RemoveEmpty=False, Tree=filter_33)
merge_5 = Merge(Data1=clean_6, Data2=filter_32)
merge_6 = Merge(Data1=clean_5, Data2=filter_30)
item_50 = ListItem(List=shatter_6, Index="1", Wrap=True)
filter_34 = StreamFilter(Gate=null_5.NullFlags, Stream0=cull_i_11, Stream1=loop_start.Data_4)
filter_35 = StreamFilter(Gate=null_5.NullFlags, Stream0=renumber_2, Stream1=loop_start.Data_2)
merge_7 = Merge(Data1=clean_4, Data2=clean_20)
merge_8 = Merge(Data1=clean_7, Data2=null_5.NullFlags)
loop_end_2 = LoopEnd(
    port=loop_start.port,
    Exit=False,
    UserFirstTargetCurve=item_50,
    OffcutCurves=filter_35,
    SelectedOffcuts=merge_5,
    NullCheckNextTarget=null_5.NullFlags,
    Data=addition_2,
    Data_2=filter_34,
    SelectedContour=merge_6,
    RightCurve=merge_7,
    Data_3=merge_8,
    _180CHECK=larger_6.LargerThan,
    Data_4=filter_6,
    Data_5=bool,
    TimeOutVal=0,
    pausedState=False,
    state="Output last")  # -> simplify(Target), Offcut, Selected, D3, D4, D5, D6, D7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
crv_23 = Curve(flatten(loop_end_2.Selected))
crv_24 = Curve(loop_end_2.D6)
crv_25 = Curve(flatten(loop_end_2.D7))
item_51 = ListItem(List=crv_24, Index=Slider(0, range=0..100), Wrap=True)
clean_21 = CleanTree(RemoveNulls=True, RemoveInvalid=True, RemoveEmpty=False, Tree=crv_24)
cull_i_12 = CullIndex(List=loop_end_2.D6, Indices="-1", Wrap=True)
cluster = Cluster(crv=cull_i_12, bool=loop_end_2.D8)
cluster_2 = Cluster_2(C=cull_i_12, C_2=crv_23)
explode_13 = Explode(Curve=clean_21, Recursive=True)  # -> Segments, Vertices
flip_4 = FlipMatrix(Data=cluster)
item_52 = ListItem(List=explode_13.Segments, Index=Slider(1, range=0..3), Wrap=True)
randcol = RandomColor(Data=clean_21, Seed=2, FastMode=False)
item_53 = ListItem(List=flip_4, Index=number_slider_9, Wrap=True)  # -> simplify(Item)
branch = TreeBranch(Tree=simplify(flip_4), Path=number_slider_9, MaintainPaths=True)
len_10 = Length(Curve=flatten(item_52))
partition_6 = PartitionList(List=cluster, Size="3")
mindex = MemberIndex(Set=len_6, Member=len_10)  # -> flatten(Index), Count
previewlw_14 = CustomPreviewLineweights(Geometry=branch, Shader=ColourSwatch(SwatchColor=RGB(0, 255, 213)), Thickness=Slider(7, range=0..10), Absolute=False)
center_5 = Center(Geometric=clean_21)  # -> flatten(Center), Dimension

panel_15 = Panel("0")  # disabled
panel_16 = Panel("0")  # disabled
item_54 = ListItem(List=explode_11.Segments, Index=panel_15, Wrap=True)  # -> flatten(Item); disabled
item_55 = ListItem(List=explode_5.Segments, Index=panel_16, Wrap=True)  # disabled
end_11 = EndPoints(Curve=item_54)  # -> Start, End; disabled
end_12 = EndPoints(Curve=item_55)  # -> Start, End; disabled
crv_cp_4 = CurveClosestPoint(Point=end_11.Start, Curve=item_54)  # -> Point, Parameter, Distance; disabled
crv_cp_5 = CurveClosestPoint(Point=end_12.End, Curve=item_55)  # -> Point, Parameter, Distance; disabled
eval = EvaluateCurve(Curve=item_55, Parameter=crv_cp_5.Parameter)  # -> Point, Tangent, Angle; disabled
eval_2 = EvaluateCurve(Curve=item_54, Parameter=crv_cp_4.Parameter)  # -> Point, Tangent, Angle; disabled
angle_4 = Angle(VectorA=eval_2.Tangent, VectorB=eval.Tangent)  # -> Angle, Reflex; disabled
vdis_2 = VectorDisplay(Anchor=end_12.End, Vector=eval.Tangent)  # disabled
bnd_4 = Bounds(Numbers=angle_4.Angle)  # disabled

item_56 = ListItem(List=center_4.Center, Index=mindex.Index, Wrap=True)
tag_2 = TextTag(Location=item_56, Text=mindex.Index, Colour=randcol)
tag_3 = TextTag(Location=center_5.Center, Text=mindex.Index, Colour=randcol)
divide_11 = DivideCurve(Curve=item_39, Count="35", Kinks=False)  # -> Points, simplify(Tangents), Parameters; disabled
divide_12 = DivideCurve(Curve=flatten_7, Count="35", Kinks=False)  # -> Points, Tangents, Parameters; disabled
angle_5 = Angle(VectorA=divide_11.Tangents, VectorB=divide_12.Tangents)  # -> simplify(Angle), Reflex; disabled
shortedge_difference = Number(abs)  # disabled
ma_10 = MassAddition(Input=angle_5.Angle)  # -> flatten(Result), PartialResults; disabled
bnd_5 = Bounds(Numbers=shortedge_difference)  # disabled
bnd_6 = Bounds(Numbers=ma_10.Result)  # disabled
remap_3 = RemapNumbers(Value=angle_4.Angle, Source=bnd_4, Target=dom)  # -> Mapped, Clipped; disabled
remap_4 = RemapNumbers(Value=shortedge_difference, Source=bnd_5, Target=dom)  # -> Mapped, Clipped; disabled
remap_5 = RemapNumbers(Value=ma_10.Result, Source=bnd_6, Target=dom)  # -> Mapped, Clipped; disabled
remap_6 = RemapNumbers(Value=ma_10.Result, Source=bnd_6, Target=Domain(0, 1))  # -> Mapped, Clipped; disabled
roundd = RoundToDecimalPlace(NumberX=remap_6.Mapped, DecimalPlace=panel_4, RoundType=0)  # -> Rounded, Difference; disabled
graft = GraftTree(Tree=remap_3.Mapped, IncludeEmptyLists=True, IncludeNullItems=True)  # disabled
graft_2 = GraftTree(Tree=remap_4.Mapped, IncludeEmptyLists=True, IncludeNullItems=True)  # disabled
graft_3 = GraftTree(Tree=remap_5.Mapped, IncludeEmptyLists=True, IncludeNullItems=True)  # disabled
addition_5 = Addition(A=graft_3, B=graft_2, C=graft)  # -> flatten(Result); disabled
bnd_7 = Bounds(Numbers=addition_5)  # disabled
remap_7 = RemapNumbers(Value=addition_5, Source=bnd_7, Target=Domain(0, 1))  # -> Mapped, Clipped; disabled
pt_6 = ConstructPoint(XCoordinate=remap_3.Mapped, YCoordinate=remap_4.Mapped, ZCoordinate=remap_5.Mapped)  # disabled
extremums_2 = MinMax(Number=addition_5)  # -> Minimum, Maximum; disabled
gradient_4 = Gradient(
    LowerLimit=extremums_2.Minimum,
    UpperLimit=extremums_2.Maximum,
    Parameter=addition_5,
    stops=[0: RGB(234, 38, 0), 0.177: RGB(234, 126, 0), 0.416: RGB(254, 244, 84), 0.697: RGB(173, 203, 249), 1: RGB(75, 107, 169)])  # disabled
project = Project(Geometry=pt_6, Plane=PlaneXY(0, 0, 0))  # -> Geometry, Transform; disabled
sph_4 = Sphere(Base=pt_6, Radius=number_slider_13)  # disabled
rectangle_2 = Rectangle(Plane=project.Geometry, XSize=dom_2, YSize=dom_2, Radius=0)  # -> Rectangle, Length; disabled
ln = Line(StartPoint=project.Geometry, EndPoint=pt_6)  # disabled
len_11 = Length(Curve=ln)  # disabled
Z_2 = UnitZ(Factor=len_11)  # disabled
extr = Extrude(Base=rectangle_2.Rectangle, Direction=Z_2)  # disabled
lng_6 = ListLength(List=remap_6.Mapped)  # disabled
split_6 = SplitList(List=sqgrid.Cells, Index=lng_6)  # -> ListA, ListB; disabled
sort_7 = SortList(Keys=addition_5, ValuesA=flatten_5, ValuesB=gradient_4, ValuesC=remap_7.Mapped)  # -> Keys, ValuesA, ValuesB, ValuesC; disabled
center_6 = Center(Geometric=sort_7.ValuesA)  # -> Center, Dimension; disabled
alpha = AdjustAlpha(Color=gradient_4, Alpha=number_slider_15)  # disabled
preview_4 = CustomPreview(Geometry=sph_4, Material=alpha)  # disabled
item_57 = ListItem(List=sort_7.ValuesB, Index=series_3, Wrap=True)  # disabled
x_minus_one_3 = XMinusOne(NumberX=lng_6)  # disabled
num_3 = Number(index_4)  # disabled
previewlw_15 = CustomPreviewLineweights(Geometry=ln, Shader=alpha, Thickness=number_slider_22, Absolute=False)  # disabled
planesrf = PlaneSurface(Plane=pt_6, XSize=Domain(-10, 10), YSize=Domain(-10, 10))  # disabled
cap = CapHoles(Brep=extr)  # disabled
divide_list = DivideList(List=sort_7.ValuesC, Number=panel_8)  # -> Chunk, Remainder; disabled
center_7 = Center(Geometric=split_6.ListA)  # -> Center, Dimension; disabled
roundd_2 = RoundToDecimalPlace(NumberX=divide_list.Chunk, DecimalPlace=panel_9, RoundType=0)  # -> Rounded, Difference; disabled
bnd_8 = Bounds(Numbers=roundd_2.Rounded)  # disabled
vec2pt_13 = Vector2Pt(PointA=center_6.Center, PointB=center_7.Center, Unitize=False)  # -> Vector, Length; disabled
sort_8 = SortList(Keys=addition_5, ValuesA=cap)  # -> Keys, ValuesA; disabled
txt = Text(flatten(bnd_8))  # disabled
move_10 = Move(Geometry=sort_7.ValuesA, Motion=vec2pt_13.Vector)  # -> Geometry, Transform; disabled
project_2 = Project(Geometry=pt_6, Plane=xy)  # -> Geometry, Transform; disabled
item_58 = ListItem(List=sort_8.ValuesA, Index=0, Wrap=True)  # disabled
item_59 = ListItem(List=move_10.Geometry, Index=0, Wrap=True)  # disabled
ln_2 = Line(StartPoint=pt_6, EndPoint=project_2.Geometry)  # disabled
edges = BrepEdges(Brep=item_58)  # -> Naked, Interior, NonManifold; disabled
previewlw_16 = CustomPreviewLineweights(Geometry=ln_2, Shader=swatch_7, Thickness=number_slider_28, Absolute=False)  # disabled
previewlw_17 = CustomPreviewLineweights(Geometry=line, Shader=alpha, Thickness=number_slider_24, Absolute=False)  # disabled
tag_4 = TextTag3D(Location=project_2.Geometry, Text=num_3, Size=number_slider_25, Colour=gradient_4, Justification=5)  # disabled
preview_5 = CustomPreview(Geometry=cap, Material=alpha)  # disabled
previewlw_18 = CustomPreviewLineweights(Geometry=rectangle.Rectangle, Shader=item_57, Thickness=number_slider_26, Absolute=False)  # disabled
tag_5 = TextTag3D(Location=arrlinear.Geometry, Text=txt, Size=number_slider_30, Colour=item_57, Justification=8)  # disabled
previewlw_19 = CustomPreviewLineweights(Geometry=[edges.Interior, item_59], Shader=swatch_8, Thickness=number_slider_29, Absolute=False)  # disabled
# Offcuts
previewlw_20 = CustomPreviewLineweights(Geometry=move_10.Geometry, Shader=sort_7.ValuesB, Thickness=number_slider_26, Absolute=False)  # disabled

# ==== cluster Cluster
bool = ClusterInput()
bool_2 = Boolean(bool)
mindex = MemberIndex(Set=bool_2, Member=Toggle(True))  # -> simplify(Index), Count
cull_i = CullIndex(List=mindex.Index, Indices="0", Wrap=True)
item = ListItem(List=mindex.Index, Index="0", Wrap=True)
lng = ListLength(List=cull_i)
crv = ClusterInput()
series = Series(Start="1", Step=1, Count=lng)
subtraction = Subtraction(A=cull_i, B=series)
crv_2 = Curve(flatten(crv))
ins = InsertItems(List=subtraction, Item=item, Indices="0", Wrap=True)
shift = ShiftList(List=ins, Shift=1, Wrap=True)  # -> simplify(graft(List))
graft = GraftTree(Tree=ins, IncludeEmptyLists=True, IncludeNullItems=True)  # -> simplify(Tree)
subtraction_2 = Subtraction(A=shift, B=graft)  # -> flatten(Result)
x_minus_one = XMinusOne(NumberX=mindex.Index)
cull_i_2 = CullIndex(List=subtraction_2, Indices="-1", Wrap=True)
clean = CleanTree(RemoveNulls=True, RemoveInvalid=True, RemoveEmpty=False, Tree=crv_2)
ma = MassAddition(Input=cull_i_2)  # -> Result, PartialResults
lng_2 = ListLength(List=clean)
subtraction_3 = Subtraction(A=lng_2, B=ma.Result)
ins_2 = InsertItems(List=cull_i_2, Item=subtraction_3, Indices="-1", Wrap=True)
partition = PartitionList(List=clean, Size=ins_2)
split_multi = SplitListMulti(List=crv_2, Index=ins)
C = ClusterOutput(split_multi)

# ==== cluster Cluster_2
C = ClusterInput()
C_2 = ClusterInput()
join_t = JoinCurvesWithTolerance(Curves=C, Tolerance="12", Option=0)
join = JoinCurves(Curves=C_2, Preserve=False)
X = UnitX(Factor=Slider(20, range=0..100))
num = Number()
move = Move(Geometry=join_t, Motion=X)  # -> Geometry, Transform
item = ListItem(List=join, Index="1", Wrap=True)
item_2 = ListItem(List=move.Geometry, Index=0, Wrap=True)
number_slider = Slider(30, range=0..100)
end = EndPoints(Curve=item)  # -> Start, End
tweencrv = TweenCurve(CurveA=item_2, CurveB=item, Factor=Slider(0.61, range=0..1), BlendType=0)
Y = UnitY(Factor=1)
contour = Contour(Curve=[item_2, item], Point=end.Start, Direction=Y, Distance=Slider(5, range=0..20))  # -> simplify(Contours), Parameters
trim = TrimTree(Tree=contour.Contours, Depth=1)
previewlw = CustomPreviewLineweights(
    Geometry=move.Geometry,
    Shader=ColourSwatch(SwatchColor=RGB(0, 221, 255)),
    Thickness=Slider(4, range=0..10),
    Absolute=False)
previewlw_2 = CustomPreviewLineweights(Geometry=join, Shader=ColourSwatch(SwatchColor=RGB(255, 0, 0)), Thickness=Slider(10, range=0..10), Absolute=False)
branch = TreeBranch(Tree=trim, Path="0", MaintainPaths=True)
branch_2 = TreeBranch(Tree=trim, Path="1", MaintainPaths=True)
ln = Line(StartPoint=branch, EndPoint=branch_2)
len = Length(Curve=ln)
larger = LargerThan(FirstNumber=len, SecondNumber="5")  # -> LargerThan, OrEqualTo
dispatch = Dispatch(List=ln, DispatchPattern=larger.LargerThan)  # -> ListA, ListB
midpt = CurveMiddle(Curve=dispatch.ListB)
pline = PolyLine(Vertices=midpt, Closed=False)
intcrv = Interpolate(Vertices=midpt, Degree=3, Periodic=False, KnotStyle=1)  # -> Curve, Length, Domain
previewlw_3 = CustomPreviewLineweights(
    Geometry=intcrv.Curve,
    Shader=ColourSwatch(SwatchColor=RGB(98, 255, 84)),
    Thickness=Slider(2, range=0..10),
    Absolute=False)
