# Grasshopper definition EDGEMATCHER_190423_update.gh (Grasshopper 1.0.7)
# plug-ins: Anemone, Human, Wombat, Heteroptera, HFTidyCanvas, EdiTree, Pufferfish, treesloth01

curve = Curve([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])
curve_2 = Curve([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])
curve_3 = Curve([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])
curve_4 = Curve([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])
curve_5 = Curve([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])
curve_6 = Curve([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])
curve_7 = Curve([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])
curve_8 = Curve([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])
curve_9 = Curve([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])
curve_10 = Curve([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])
curve_11 = Curve([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])
curve_12 = Curve([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])
curve_13 = Curve([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])
curve_14 = Curve([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])
curve_15 = Curve([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])
curve_16 = Curve([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])
curve_17 = Curve([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])
curve_18 = Curve([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])
curve_19 = Curve([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])
curve_20 = Curve([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])
curve_21 = Curve([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])

curve_22 = Curve([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])
curve_23 = Curve([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])
curve_24 = Curve([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])
curve_25 = Curve([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])
curve_26 = Curve([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])
_14 = Curve([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])
curve_27 = Curve([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])
_4 = Curve([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])
curve_28 = Curve([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])

crv = Curve([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])
panel = Panel("""3
6
13
9""")

number_slider = Slider(5, range=0..10)
number_slider_2 = Slider(9, range=0..100)
crv_2 = Curve([<curve referenced from the Rhino model> x5])

crv_3 = Curve([<curve referenced from the Rhino model> x22])
yz = YZPlane(Origin=Point(0, 0, 0))
crv_4 = Curve([<curve referenced from the Rhino model> x29])
crv_5 = Curve(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)
crv_6 = Curve([<curve referenced from the Rhino model> x7])
rotate = Rotate(Geometry=crv_4, Angle=1.570796327, Plane=yz)  # -> Geometry, Transform
divlength = DivideLength(Curve=crv_5, Length=Slider(6, range=0..10))  # -> Points, Tangents, Parameters
rotate_2 = Rotate(Geometry=crv_6, Angle=1.570796327, Plane=yz)  # -> Geometry, Transform
divlength_2 = DivideLength(Curve=crv_4, Length=Slider(5, range=0..10))  # -> Points, Tangents, Parameters
divlength_3 = DivideLength(Curve=rotate_2.Geometry, Length=Slider(5, range=0..10))  # -> Points, Tangents, Parameters
cull = CullPattern(List=divlength.Points, CullPattern=[False, True])
col = Colour(RGB(179, 0, 255))
cull_2 = CullPattern(List=divlength_2.Points, CullPattern=[False, True])
swatch = ColourSwatch(SwatchColor=RGB(255, 255, 255))
col_2 = Colour(RGB(179, 0, 255))
partition = PartitionList(List=cull, Size=2)
swatch_2 = ColourSwatch(SwatchColor=RGB(255, 255, 255))
cull_3 = CullPattern(List=divlength_3.Points, CullPattern=[False, True])
partition_2 = PartitionList(List=cull_2, Size=2)
col_3 = Colour(RGB(179, 0, 255))
swatch_3 = ColourSwatch(SwatchColor=RGB(255, 255, 255))
pline = PolyLine(Vertices=partition, Closed=False)
partition_3 = PartitionList(List=cull_3, Size=2)
pline_2 = PolyLine(Vertices=partition_2, Closed=False)
swatch_4 = ColourSwatch(SwatchColor=RGB(148, 248, 255))
swatch_5 = ColourSwatch(SwatchColor=RGB(148, 248, 255))
pline_3 = PolyLine(Vertices=partition_3, Closed=False)
previewlw = CustomPreviewLineweights(Geometry=pline, Shader=col, Thickness=Slider(7, range=0..10), Absolute=False)
gradient = Gradient(
    LowerLimit=0,
    UpperLimit=1,
    Parameter=pline_3,
    stops=[0: RGB(102, 255, 224), 0.116: RGB(64, 184, 146), 0.267: RGB(57, 181, 230), 0.547: RGB(91, 62, 181), 0.791: RGB(179, 0, 255)])
previewlw_2 = CustomPreviewLineweights(Geometry=pline_2, Shader=swatch_4, Thickness=Slider(6, range=0..10), Absolute=False)
previewlw_3 = CustomPreviewLineweights(Geometry=crv_3, Shader=swatch_4, Thickness=Slider(2, range=0..10), Absolute=False)
previewlw_4 = CustomPreviewLineweights(Geometry=pline_3, Shader=gradient, Thickness=Slider(3, range=0..10), Absolute=False)

# ---- group: Target curves
crv_7 = Curve([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])

# ----
crv_8 = Curve(<curve referenced from the Rhino model>)
double_curves = DataDescription([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])
single_curves = Curve([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])
item = ListItem(List=crv_2, Index=Slider(4, range=0..4), Wrap=True)

divide = DivideCurve(Curve=crv_8, Count=10, Kinks=False)  # -> Points, Tangents, Parameters
previewlw_5 = CustomPreviewLineweights(Geometry=crv_8, Shader=ColourSwatch(SwatchColor=RGB(130, 255, 153)), Thickness=Slider(10, range=0..10), Absolute=False)
pdecon = Deconstruct(Point=divide.Points)  # -> XComponent, YComponent, ZComponent
ma = MassAddition(Input=pdecon.XComponent)  # -> flatten(Result), PartialResults
sort = SortList(Keys=ma.Result, ValuesA=crv_8)  # -> Keys, ValuesA
previewlw_6 = CustomPreviewLineweights(
    Geometry=sort.ValuesA,
    Shader=ColourSwatch(SwatchColor=RGB(255, 255, 255)),
    Thickness=Slider(5, range=0..10),
    Absolute=False)

panel_2 = Panel("4")
item_2 = ListItem(List=sort.ValuesA, Index=0, Wrap=True)
cull_i = CullIndex(List=sort.ValuesA, Indices="0", Wrap=True)
toggle = BooleanToggle(False)
number_slider_3 = Slider(100, range=0..100)
number_slider_4 = Slider(20, range=0..20)
number_slider_5 = Slider(0, range=0..3)
item_3 = ListItem(Index=0, Wrap=True)
subtree = SubTree()  # -> Path, SubTree

panel_3 = Panel("0")  # disabled
panel_4 = Panel("0")  # disabled
item_4 = ListItem(Index=panel_3, Wrap=True)  # -> flatten(Item); disabled
item_5 = ListItem(Index=panel_4, Wrap=True)  # disabled
end = EndPoints(Curve=item_4)  # -> Start, End; disabled
end_2 = EndPoints(Curve=item_5)  # -> Start, End; disabled
crv_cp = CurveClosestPoint(Point=end.Start, Curve=item_4)  # -> Point, Parameter, Distance; disabled
crv_cp_2 = CurveClosestPoint(Point=end_2.End, Curve=item_5)  # -> Point, Parameter, Distance; disabled
eval = EvaluateCurve(Curve=item_5, Parameter=crv_cp_2.Parameter)  # -> Point, Tangent, Angle; disabled
eval_2 = EvaluateCurve(Curve=item_4, Parameter=crv_cp.Parameter)  # -> Point, Tangent, Angle; disabled
angle = Angle(VectorA=eval_2.Tangent, VectorB=eval.Tangent)  # -> Angle, Reflex; disabled
vdis = VectorDisplay(Anchor=end_2.End, Vector=eval.Tangent)  # disabled
bnd = Bounds(Numbers=angle.Angle)  # disabled

divide_2 = DivideCurve(Count=10, Kinks=False)  # -> Points, simplify(Tangents), Parameters; disabled
divide_3 = DivideCurve(Count=10, Kinks=False)  # -> Points, Tangents, Parameters; disabled
number_slider_6 = Slider(1000, range=0..5000)  # disabled
angle_2 = Angle(VectorA=divide_2.Tangents, VectorB=divide_3.Tangents)  # -> simplify(Angle), Reflex; disabled
shortedge_difference = Number()  # disabled
ma_2 = MassAddition(Input=angle_2.Angle)  # -> flatten(Result), PartialResults; disabled
panel_5 = Panel("0")  # disabled
dom = ConstructDomain(DomainStart=panel_5, DomainEnd=number_slider_6)  # disabled
bnd_2 = Bounds(Numbers=shortedge_difference)  # disabled
bnd_3 = Bounds(Numbers=ma_2.Result)  # disabled
remap = RemapNumbers(Value=angle.Angle, Source=bnd, Target=dom)  # -> Mapped, Clipped; disabled
panel_6 = Panel("2")  # disabled
remap_2 = RemapNumbers(Value=shortedge_difference, Source=bnd_2, Target=dom)  # -> Mapped, Clipped; disabled
remap_3 = RemapNumbers(Value=ma_2.Result, Source=bnd_3, Target=dom)  # -> Mapped, Clipped; disabled
remap_4 = RemapNumbers(Value=ma_2.Result, Source=bnd_3, Target=Domain(0, 1))  # -> Mapped, Clipped; disabled
roundd = RoundToDecimalPlace(NumberX=remap_4.Mapped, DecimalPlace=panel_6, RoundType=0)  # -> Rounded, Difference; disabled
graft = GraftTree(Tree=remap.Mapped, IncludeEmptyLists=True, IncludeNullItems=True)  # disabled
graft_2 = GraftTree(Tree=remap_2.Mapped, IncludeEmptyLists=True, IncludeNullItems=True)  # disabled
graft_3 = GraftTree(Tree=remap_3.Mapped, IncludeEmptyLists=True, IncludeNullItems=True)  # disabled
addition = Addition(A=graft_3, B=graft_2, C=graft)  # -> flatten(Result); disabled
bnd_4 = Bounds(Numbers=addition)  # disabled
number_slider_7 = Slider(-38, range=-100..0)  # disabled
number_slider_8 = Slider(100, range=0..100)  # disabled
remap_5 = RemapNumbers(Value=addition, Source=bnd_4, Target=Domain(0, 1))  # -> Mapped, Clipped; disabled
number_slider_9 = Slider(38, range=0..100)  # disabled
pt = ConstructPoint(XCoordinate=remap.Mapped, YCoordinate=remap_2.Mapped, ZCoordinate=remap_3.Mapped)  # disabled
extremums = MinMax(Number=addition)  # -> Minimum, Maximum; disabled
panel_7 = Panel("1000")  # disabled
number_slider_10 = Slider(100, range=0..100)  # disabled
neg = Negative(Value=number_slider_7)  # disabled
gradient_2 = Gradient(
    LowerLimit=extremums.Minimum,
    UpperLimit=extremums.Maximum,
    Parameter=addition,
    stops=[0: RGB(234, 38, 0), 0.177: RGB(234, 126, 0), 0.416: RGB(254, 244, 84), 0.697: RGB(173, 203, 249), 1: RGB(75, 107, 169)])  # disabled
dom_2 = ConstructDomain(DomainStart=number_slider_7, DomainEnd=neg)  # disabled
project = Project(Geometry=pt, Plane=PlaneXY(0, 0, 0))  # -> Geometry, Transform; disabled
number_slider_11 = Slider(0.376, range=0..1)  # disabled
number_slider_12 = Slider(14, range=0..100)  # disabled
number_slider_13 = Slider(247, range=0..250)  # disabled
sph = Sphere(Base=pt, Radius=number_slider_9)  # disabled
rectangle = Rectangle(Plane=project.Geometry, XSize=dom_2, YSize=dom_2, Radius=0)  # -> Rectangle, Length; disabled
number_slider_14 = Slider(2, range=0..10)  # disabled
number_slider_15 = Slider(6, range=0..10)  # disabled
ln = Line(StartPoint=project.Geometry, EndPoint=pt)  # disabled
pt_2 = ConstructPoint(XCoordinate=0, YCoordinate=0, ZCoordinate=0)  # disabled
number_slider_16 = Slider(39, range=0..100)  # disabled
len = Length(Curve=ln)  # disabled
Z = UnitZ(Factor=len)  # disabled
number_slider_17 = Slider(1000, range=0..1000)  # disabled
relay = Relay()  # disabled
panel_8 = Panel("12")  # disabled
panel_9 = Panel("7")  # disabled
extr = Extrude(Base=rectangle.Rectangle, Direction=Z)  # disabled
number_slider_18 = Slider(8, range=0..10)  # disabled
multiplication = Multiplication(A=number_slider_13, B=number_slider_14)  # disabled
division = Division(A=number_slider_12, B=number_slider_14)  # disabled
lng = ListLength(List=remap_4.Mapped)  # disabled
series = Series(Start=0, Step=panel_8, Count=panel_9)  # disabled
sort_2 = SortList(Keys=addition, ValuesA=relay, ValuesB=gradient_2, ValuesC=remap_5.Mapped)  # -> Keys, ValuesA, ValuesB, ValuesC; disabled
Y = UnitY(Factor=number_slider_16)  # disabled
X = UnitX(Factor=number_slider_13)  # disabled
pt_3 = Point(<point referenced from the Rhino model>)  # disabled
center = Center(Geometric=sort_2.ValuesA)  # -> Center, Dimension; disabled
alpha = AdjustAlpha(Color=gradient_2, Alpha=number_slider_11)  # disabled
preview = CustomPreview(Geometry=sph, Material=alpha)  # disabled
item_6 = ListItem(List=sort_2.ValuesB, Index=series, Wrap=True)  # disabled
neg_2 = Negative(Value=Y)  # disabled
X_2 = UnitX(Factor=multiplication)  # disabled
x_minus_one = XMinusOne(NumberX=lng)  # disabled
Z_2 = UnitZ(Factor=1)  # disabled
X_3 = UnitX(Factor=1)  # disabled
Y_2 = UnitY(Factor=1)  # disabled
panel_10 = Panel("7")  # disabled
sqgrid = Square(Plane=pt_3, Size=number_slider_13, ExtentX=number_slider_12, ExtentY=number_slider_15)  # -> flatten(Cells), Points; disabled
split = SplitList(List=sqgrid.Cells, Index=lng)  # -> ListA, ListB; disabled
number_slider_19 = Slider(1253, range=0..10000)  # disabled
num = Number()  # disabled
previewlw_7 = CustomPreviewLineweights(Geometry=ln, Shader=alpha, Thickness=number_slider_18, Absolute=False)  # disabled
addition_2 = Addition(A=X, B=neg_2)  # disabled
neg_3 = Negative(Value=X_3)  # disabled
neg_4 = Negative(Value=Y_2)  # disabled
planesrf = PlaneSurface(Plane=pt, XSize=Domain(-10, 10), YSize=Domain(-10, 10))  # disabled
cap = CapHoles(Brep=extr)  # disabled
divide_list = DivideList(List=sort_2.ValuesC, Number=panel_10)  # -> Chunk, Remainder; disabled
number_slider_20 = Slider(3, range=0..10)  # disabled
move = Move(Geometry=pt_3, Motion=addition_2)  # -> Geometry, Transform; disabled
panel_11 = Panel("2")  # disabled
center_2 = Center(Geometric=split.ListA)  # -> Center, Dimension; disabled
roundd_2 = RoundToDecimalPlace(NumberX=divide_list.Chunk, DecimalPlace=panel_11, RoundType=0)  # -> Rounded, Difference; disabled
pt_4 = ConstructPoint(XCoordinate=0, YCoordinate=0, ZCoordinate=number_slider_19)  # disabled
line = LineSDL(Start=pt_2, Direction=[Y_2, X_3, Z_2], Length=number_slider_17)  # disabled
bnd_5 = Bounds(Numbers=roundd_2.Rounded)  # disabled
vec2pt = Vector2Pt(PointA=center.Center, PointB=center_2.Center, Unitize=False)  # -> Vector, Length; disabled
number_slider_21 = Slider(37, range=0..100)  # disabled
xy = XYPlane(Origin=pt_4)  # disabled
arrlinear = LinearArray(Geometry=move.Geometry, Direction=X_2, Count=division)  # -> Geometry, Transform; disabled
sort_3 = SortList(Keys=addition, ValuesA=cap)  # -> Keys, ValuesA; disabled
number_slider_22 = Slider(3, range=0..10)  # disabled
txt = Text(flatten(bnd_5))  # disabled
move_2 = Move(Geometry=sort_2.ValuesA, Motion=vec2pt.Vector)  # -> Geometry, Transform; disabled
project_2 = Project(Geometry=pt, Plane=xy)  # -> Geometry, Transform; disabled
item_7 = ListItem(List=sort_3.ValuesA, Index=0, Wrap=True)  # disabled
item_8 = ListItem(List=move_2.Geometry, Index=0, Wrap=True)  # disabled
number_slider_23 = Slider(1, range=0..10)  # disabled
number_slider_24 = Slider(1, range=0..10)  # disabled
rectangle_2 = Rectangle(Plane=arrlinear.Geometry, XSize=Domain(-110, 110), YSize=Domain(-5, 33), Radius=0)  # -> Rectangle, Length; disabled
ln_2 = Line(StartPoint=pt, EndPoint=project_2.Geometry)  # disabled
edges = BrepEdges(Brep=item_7)  # -> Naked, Interior, NonManifold; disabled
swatch_6 = ColourSwatch(SwatchColor=RGB(255, 255, 255))  # disabled
swatch_7 = ColourSwatch(SwatchColor=RGB(255, 255, 255))  # disabled
number_slider_25 = Slider(5, range=0..10)  # disabled
previewlw_8 = CustomPreviewLineweights(Geometry=ln_2, Shader=swatch_7, Thickness=number_slider_24, Absolute=False)  # disabled
number_slider_26 = Slider(28, range=0..100)  # disabled
swatch_8 = ColourSwatch(SwatchColor=RGB(255, 0, 0))  # disabled
previewlw_9 = CustomPreviewLineweights(Geometry=line, Shader=alpha, Thickness=number_slider_20, Absolute=False)  # disabled
tag = TextTag3D(Location=project_2.Geometry, Text=num, Size=number_slider_21, Colour=gradient_2, Justification=5)  # disabled
preview_2 = CustomPreview(Geometry=cap, Material=alpha)  # disabled
previewlw_10 = CustomPreviewLineweights(Geometry=rectangle_2.Rectangle, Shader=item_6, Thickness=number_slider_22, Absolute=False)  # disabled
tag_2 = TextTag3D(Location=arrlinear.Geometry, Text=txt, Size=number_slider_26, Colour=item_6, Justification=8)  # disabled
# Offcuts
previewlw_11 = CustomPreviewLineweights(Geometry=[edges.Interior, item_8], Shader=swatch_8, Thickness=number_slider_25, Absolute=False)  # disabled
previewlw_12 = CustomPreviewLineweights(Geometry=move_2.Geometry, Shader=sort_2.ValuesB, Thickness=number_slider_22, Absolute=False)  # disabled

stack = StackTrees(
    Data0=curve_2,
    Data1=curve_11,
    Data2=curve_20,
    Data3=curve_4,
    Data4=curve_5,
    Data5=curve_13,
    Data6=curve_14,
    Data7=curve_15,
    Data8=curve_6,
    Data9=curve_21,
    Data10=curve_7,
    Data11=curve,
    Data12=curve_17,
    Data13=curve_18,
    Data14=curve_10,
    Data15=curve_19,
    Reduce=True)
item_9 = ListItem(List=stack, Index=0, Wrap=True)
center_3 = Center(Geometric=item_9)  # -> Center, Dimension
sqgrid_2 = Square(Plane=PlaneXY(0, 0, 0), Size=Slider(240, range=0..10000), ExtentX=5, ExtentY=5)  # -> Cells, Points
center_4 = Center(Geometric=sqgrid_2.Cells)  # -> simplify(Center), Dimension

tstat = TreeStatistics(Tree=stack)  # -> Paths, Length, Count
scale = Scale(Geometry=stack, Center=center_3.Center, Factor="0.1")  # -> Geometry, Transform

series_2 = Series(Start=0, Step=1, Count=tstat.Count)
item_10 = ListItem(List=flatten(center_4.Center), Index=series_2, Wrap=True)
orient = Orient(Geometry=scale.Geometry, Source=center_3.Center, Target=graft(item_10))  # -> Geometry, Transform

curve_29 = Curve([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])
curve_30 = Curve([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])
curve_31 = Curve([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])
curve_32 = Curve([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])
curve_33 = Curve([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])
curve_34 = Curve([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])
cull_i_2 = CullIndex(List=curve_29, Indices="0", Wrap=True)
scale_2 = Scale(Center=Point(0, 0, 0), Factor=Slider(0.1, range=0..0.1))  # -> Geometry, Transform
partition_4 = PartitionList(List=cull_i_2, Size="5")
partition_5 = PartitionList(List=scale_2.Geometry, Size="5")
item_11 = ListItem(List=cull_i_2, Index=Slider(3, range=0..10), Wrap=True)
cull_i_3 = CullIndex(List=orient.Geometry, Indices="0", Wrap=True)
len_2 = Length(Curve=item_11)
panel_12 = Panel(len_2)
shift = ShiftList(List=cull_i_3, Shift=1, Wrap=True)
join_t = JoinCurvesWithTolerance(Curves=shift, Tolerance=Slider(27, range=0..100), Option=0)  # -> flatten(Curve)

index = ItemIndex(List=flatten(center_3.Center), Item=flatten(center_3.Center))
cull_i_4 = CullIndex(List=orient.Geometry, Indices=Slider(0, range=0..100), Wrap=True)
end_3 = EndPoints(Curve=cull_i_4)  # -> Start, End
item_12 = ListItem(List=orient.Geometry, Index=Slider(0, range=0..4), Wrap=True)
x_plus_one = XPlusOne(NumberX=index)
vec2pt_2 = Vector2Pt(PointA=end_3.Start, PointB=end_3.End, Unitize=False)  # -> Vector, Length
tag_3 = TextTag3D(Location=flatten(center_4.Center), Text=flatten(x_plus_one), Size=Slider(69, range=0..100), Justification=1)
vdis_2 = VectorDisplay(Anchor=end_3.Start, Vector=vec2pt_2.Vector)
preview_3 = CustomPreview(Geometry=sqgrid_2.Cells, Material=ColourSwatch(SwatchColor=RGB(178, 115, 255)))
preview_4 = CustomPreview(Geometry=item_12, Material=ColourSwatch(SwatchColor=RGB(99, 255, 224)))
dup = DuplicateData(Data=join_t, Number=number_slider, Order=True)
repeat = RepeatData(Data=dup, Length=number_slider)
center_5 = Center(Geometric=dup)  # -> Center, Dimension
replace = ReplaceItems(List=crv, Item=dup, Indices=panel, Wrap=False)
item_13 = ListItem(List=dup, Index=Slider(1, range=0..20), Wrap=True)
explode = Explode(Curve=dup, Recursive=True)  # -> Segments, Vertices
item_14 = ListItem(List=explode.Segments, Index=Slider(1, range=0..3), Wrap=True)
explode_2 = Explode(Curve=dup, Recursive=True)  # -> Segments, Vertices
explode_3 = Explode(Curve=dup, Recursive=True)  # -> Segments, Vertices
item_15 = ListItem(List=explode_2.Segments, Index=Slider(1, range=0..10), Wrap=True)  # -> flatten(Item)
item_16 = ListItem(List=explode_2.Segments, Index=Slider(3, range=0..10), Wrap=True)  # -> flatten(Item)
merge = Merge(Data1=item_15, Data2=item_16)

# ---- group: Overlap
short_edge_overlap = Slider(6, range=0..10)
end_4 = EndPoints(Curve=merge)  # -> Start, End
cir = Circle(Plane=end_4.Start, Radius=short_edge_overlap)  # -> graft(Circle)
cir_2 = Circle(Plane=end_4.End, Radius=short_edge_overlap)  # -> graft(Circle)
ccx = CurveCurve(CurveA=graft(merge), CurveB=[cir, cir_2])  # -> Points, ParamsA, ParamsB
trim = TrimTree(Tree=ccx.ParamsA, Depth=1)
shatter = Shatter(Curve=graft(merge), Parameters=trim)
item_17 = ListItem(List=shatter, Index="1", Wrap=True)  # -> flatten(Item)

# ----
lng_2 = ListLength(List=dup)
crv_9 = Curve(item_17)
split_2 = SplitList(List=crv_9, Index=lng_2)  # -> graft(ListA), graft(ListB)
merge_2 = Merge(Data1=split_2.ListA, Data2=split_2.ListB)  # -> simplify(Result)
dup_2 = DuplicateData(Data=merge_2, Number=2, Order=True)
loop_start = LoopStart(
    Repeat=Slider(40, range=0..100),
    Trigger=Button(),
    TargetCurve=item_2,
    OffcutCurves=merge_2,
    Data_2="0",
    Data_3="0",
    FullOffcut=dup,
    Data_8="0",
    Data_9="False")  # -> port, Counter, Data, Data_2, SelctedOffcuts, NullCheckNextTarget, Data_3, Data_4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
filter = StreamFilter(Gate=loop_start.NullCheckNextTarget, Stream0="0", Stream1="1")
addition_3 = Addition(A=loop_start.Data_3, B=filter)
bool = Boolean(loop_start.NullCheckNextTarget)
join = JoinCurves(Curves=loop_start.SelctedOffcuts, Preserve=False)  # -> flatten(Curves)
item_18 = ListItem(List=loop_start.Data, Index=0, Wrap=True)
relay_2 = DataDescription(loop_start.Data_4)
item_19 = ListItem(List=loop_start.Data_2, Index="1", Wrap=True)  # -> flatten(Item)
item_20 = ListItem(List=loop_start.Data_2, Index=0, Wrap=True)  # -> flatten(Item)
rotate_3 = Rotate(Geometry=item_19, Angle=degrees(Slider(180, range=0..1000)), Plane=PlaneXY(0, 0, 0))  # -> Geometry, Transform
rotate_4 = Rotate(Geometry=relay_2, Angle=degrees(Slider(180, range=0..1000)), Plane=PlaneXY(0, 0, 0))  # -> Geometry, Transform
selected_offcuts_d2 = DataDescription(loop_start.SelctedOffcuts)
relay_3 = DataDescription(loop_start.Data_6)
clean = CleanTree(RemoveNulls=True, RemoveInvalid=True, RemoveEmpty=False, Tree=relay_3)
clean_2 = CleanTree(RemoveNulls=True, RemoveInvalid=True, RemoveEmpty=False, Tree=selected_offcuts_d2)
clean_3 = CleanTree(RemoveNulls=True, RemoveInvalid=True, RemoveEmpty=False, Tree=loop_start.Data_7)
crv_10 = Curve(dup)
explode_4 = Explode(Curve=crv_10, Recursive=True)  # -> Segments, Vertices
item_21 = ListItem(List=explode_4.Segments, Index=Slider(1, range=0..3), Wrap=True)
len_3 = Length(Curve=flatten(item_21))
original_curves = Curve(merge)
center_6 = Center(Geometric=crv_10)  # -> flatten(Center), Dimension

crv_11 = Curve(loop_start.Data_6)
panel_13 = Panel("25")
swatch_9 = ColourSwatch(SwatchColor=RGB(148, 248, 255))

clean_4 = CleanTree(RemoveNulls=True, RemoveInvalid=True, RemoveEmpty=False, Tree=crv_11)
lng_3 = ListLength(List=clean_4)
filter_2 = StreamFilter(Gate=loop_start.Data_8, Stream0=loop_start.NextCurveIndex, Stream1=lng_3)
x_minus_one_2 = XMinusOne(NumberX=filter_2)
split_3 = SplitList(List=clean_4, Index=x_minus_one_2)  # -> ListA, ListB

join_t_2 = JoinCurvesWithTolerance(Curves=split_3.ListB, Tolerance=Slider(27, range=0..29), Option=0)
reb = RebuildCurve(Curve=join_t_2, Count=Slider(20, range=0..100), Tangents=False)
divide_4 = DivideCurve(Curve=reb, Count=10, Kinks=False)  # -> Points, Tangents, Parameters
pdecon_2 = Deconstruct(Point=divide_4.Points)  # -> XComponent, YComponent, ZComponent
ma_3 = MassAddition(Input=pdecon_2.XComponent)  # -> flatten(Result), PartialResults
sort_4 = SortList(Keys=ma_3.Result, ValuesA=reb)  # -> Keys, ValuesA
item_22 = ListItem(List=sort_4.ValuesA, Index="-1", Wrap=True)

previewlw_13 = CustomPreviewLineweights(Geometry=join, Shader=swatch_9, Thickness=Slider(6, range=0..10), Absolute=False)
previewlw_14 = CustomPreviewLineweights(Geometry=item_22, Shader=swatch_9, Thickness=Slider(5, range=0..10), Absolute=False)

filter_3 = StreamFilter(Gate=loop_start.NullCheckNextTarget, Stream0=item_18, Stream1=item_22)
crv_12 = Curve(filter_3)

crv_13 = Curve(item_20)
crv_14 = Curve(rotate_3.Geometry)
target = Curve(crv_12)
crv_15 = Curve(rotate_4.Geometry)
crv_16 = Curve(relay_2)

# ---- group: Orient offcut curves to target curve
merge_3 = Merge(Data1=crv_13, Data2=crv_14)
merge_4 = Merge(Data1=crv_16, Data2=crv_15)
end_5 = EndPoints(Curve=merge_3)  # -> Start, End
end_6 = EndPoints(Curve=target)  # -> Start, End
vec2pt_3 = Vector2Pt(PointA=end_6.Start, PointB=end_6.End, Unitize=False)  # -> Vector, Length
vec2pt_4 = Vector2Pt(PointA=end_5.Start, PointB=end_6.Start, Unitize=False)  # -> Vector, Length
vec2pt_5 = Vector2Pt(PointA=end_5.Start, PointB=end_5.End, Unitize=False)  # -> Vector, Length
move_3 = Move(Geometry=merge_3, Motion=vec2pt_4.Vector)  # -> Geometry, Transform
dist = Distance(PointA=end_5.Start, PointB=end_5.End)
end_7 = EndPoints(Curve=move_3.Geometry)  # -> Start, End
pt_5 = Point(end_7.Start)
sph_2 = Sphere(Base=end_7.Start, Radius=dist)
bcx = BrepCurve(Brep=sph_2, Curve=target)  # -> Curves, simplify(flatten(Points))
transform = Transform(Geometry=merge_4, Transform=move_3.Transform)
null = NullItem(Item=bcx.Points)  # -> NullFlags, flatten(InvalidFlags), Description
vec2pt_6 = Vector2Pt(PointA=end_7.Start, PointB=bcx.Points, Unitize=False)  # -> Vector, Length
mm = MassMultiplication(Input=null.InvalidFlags)  # -> Result, PartialResults
crv_cp_3 = CurveClosestPoint(Point=bcx.Points, Curve=target)  # -> Point, Parameter, Distance
filter_4 = StreamFilter(Gate=mm.Result, Stream0=vec2pt_6.Vector, Stream1=vec2pt_3.Vector)
shatter_2 = Shatter(Curve=graft(target), Parameters=graft(crv_cp_3.Parameter))  # -> simplify(Segments)
rotate_5 = RotateDirection(Geometry=move_3.Geometry, Center=end_7.Start, From=vec2pt_5.Vector, To=filter_4)  # -> Geometry, Transform
item_23 = ListItem(List=shatter_2, Index=0, Wrap=True)
transform_2 = Transform(Geometry=transform, Transform=rotate_5.Transform)

# ----
bcx_2 = BrepCurve(Brep=sph_2, Curve=target)  # -> Curves, simplify(Points)
null_2 = NullItem(Item=bcx_2.Points)  # -> flatten(NullFlags), InvalidFlags, Description
mindex = MemberIndex(Set=null_2.NullFlags, Member=Toggle(True))  # -> Index, Count

# ---- group: Find the best fit
divide_5 = DivideCurve(Curve=flatten(item_23), Count=number_slider_3, Kinks=False)  # -> Points, Tangents, Parameters
divide_6 = DivideCurve(Curve=rotate_5.Geometry, Count=number_slider_3, Kinks=False)  # -> Points, Tangents, Parameters
angle_3 = Angle(VectorA=divide_5.Tangents, VectorB=divide_6.Tangents)  # -> Angle, Reflex
dist_2 = Distance(PointA=divide_5.Points, PointB=divide_6.Points)
ma_4 = MassAddition(Input=dist_2)  # -> flatten(Result), PartialResults
ma_5 = MassAddition(Input=angle_3.Angle)  # -> flatten(Result), PartialResults
bnd_6 = Bounds(Numbers=ma_5.Result)
bnd_7 = Bounds(Numbers=ma_4.Result)
remap_6 = RemapNumbers(Value=ma_4.Result, Source=bnd_7, Target=Domain(0, 1))  # -> Mapped, Clipped
remap_7 = RemapNumbers(Value=ma_5.Result, Source=bnd_6, Target=Domain(0, 1))  # -> Mapped, Clipped
addition_4 = Addition(A=remap_7.Mapped, B=remap_6.Mapped)
index_2 = ItemIndex(List=addition_4, Item=addition_4)
sort_5 = SortList(Keys=addition_4, ValuesA=index_2)  # -> Keys, ValuesA
number_slider_27 = Slider(5, range=0..10)
index_3 = ItemIndex(List=ma_4.Result, Item=ma_4.Result)
sort_6 = SortList(Keys=ma_4.Result, ValuesA=index_3)  # -> Keys, ValuesA
addition_5 = Addition(A=loop_start.Counter, B=Slider(9, range=0..10))
split_4 = SplitList(List=sort_5.ValuesA, Index=number_slider_27)  # -> ListA, ListB
random = Random(Range=number_slider_27, Number=1, Seed=addition_5)
item_24 = ListItem(List=sort_6.ValuesA, Index=0, Wrap=True)
item_25 = ListItem(List=split_4.ListA, Index=random, Wrap=True)
item_26 = ListItem(List=rotate_5.Geometry, Index=item_24, Wrap=True)

# ----
addition_6 = Addition(A=ma_5.Result, B=ma_4.Result)
sort_7 = SortList(Keys=addition_6)  # -> Keys, ValuesA
item_27 = ListItem(List=sort_7.Keys, Index=random, Wrap=True)
panel_14 = Panel(random)
rec = DataRecorder(item_27, DataLimit=-10, RecordData=True)
clean_5 = CleanTree(RemoveNulls=True, RemoveInvalid=True, RemoveEmpty=False, Tree=rec)
panel_15 = Panel(rec)
ma_6 = MassAddition(Input=clean_5)  # -> Result, PartialResults

# ---- group: Checks if curve is flipped 180
lng_4 = ListLength(List=sort_5.ValuesA)
division_2 = Division(A=lng_4, B="2")
larger = LargerThan(FirstNumber=item_25, SecondNumber=division_2)  # -> LargerThan, OrEqualTo

# ----
panel_16 = Panel(ma_6.Result)
filter_5 = StreamFilter(Gate=larger.OrEqualTo, Stream0="0", Stream1=division_2)

# ---- group: Index of selected offcut
subtraction = Subtraction(A=item_25, B=filter_5)

# ---- group: t-param on target curve
item_28 = ListItem(List=crv_cp_3.Parameter, Index=item_25, Wrap=True)

# ---- group: Best fitting curve
item_29 = ListItem(List=rotate_5.Geometry, Index=item_25, Wrap=True)

# ---- group: Best fitting contour
item_30 = ListItem(List=transform_2, Index=item_25, Wrap=True)

# ----
explode_5 = Explode(Curve=item_30, Recursive=True)  # -> Segments, Vertices
filter_6 = StreamFilter(Gate=larger.OrEqualTo, Stream0="3", Stream1="1")
item_31 = ListItem(List=explode_5.Segments, Index=filter_6, Wrap=True)
X_4 = UnitX(Factor=1)
divide_7 = DivideCurve(Curve=item_31, Count=10, Kinks=False)  # -> Points, Tangents, Parameters
divide_8 = DivideCurve(Curve=item_29, Count=10, Kinks=False)  # -> Points, Tangents, Parameters
vec2pt_7 = Vector2Pt(PointA=divide_7.Points, PointB=divide_8.Points, Unitize=False)  # -> Vector, Length
ma_7 = MassAddition(Input=vec2pt_7.Vector)  # -> Result, PartialResults
multiplication_2 = Multiplication(A=ma_7.Result, B=Slider(0.0386, range=0..0.05))
move_4 = Move(Geometry=item_31, Motion=multiplication_2)  # -> Geometry, Transform
subtraction_2 = Subtraction(A="0", B=Slider(5, range=0..10))
ext = ExtendCurve(Curve=move_4.Geometry, Type=0, Start="0", End=subtraction_2)
filter_7 = StreamFilter(Gate=0, Stream0=ext, Stream1=move_4.Geometry)

shatter_3 = Shatter(Curve=target, Parameters=item_28)
expression = Expression(x=subtraction, Expression="Format(\"{{{0}}}\", x)")

number_slider_28 = Slider(11, range=0..11)
number_slider_29 = Slider(3, range=0..10)
crv_17 = Curve([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])
series_3 = Series(Start=0, Step=1, Count=number_slider_28)
series_4 = Series(Start=0, Step=1, Count=number_slider_28)
lng_5 = ListLength(List=crv_11)
subtraction_3 = Subtraction(A=lng_5, B=number_slider_28)
contour = DataDescription(loop_start.Data_5)
item_32 = ListItem(List=crv_17, Index=series_4, Wrap=True)
item_33 = ListItem(List=contour, Index=series_3, Wrap=True)
clean_6 = CleanTree(RemoveNulls=True, RemoveInvalid=True, RemoveEmpty=False, Tree=item_33)
crv_18 = Curve(crv_11)
series_5 = Series(Start=0, Step=0, Count=subtraction_3)
item_34 = ListItem(List=crv_11, Index=series_4, Wrap=True)
num_2 = Number([481.8181208, 265.7230537, 177.267224, 382.4396069, 299.4336738, 182.3955784, 371.1783537, 339.1980562, 462.2005754, 323.1429644, 188.5525511, 299.5755577])
len_4 = Length(Curve=clean_6)
ins = InsertItems(List=item_34, Item=series_5, Indices=number_slider_28, Wrap=True)
crv_19 = Curve(relay_2)
bnd_8 = Bounds(Numbers=num_2)
extremums_2 = MinMax(Number=num_2)  # -> Minimum, Maximum
num_3 = Number([3, 6, 8, 9])
len_5 = Length(Curve=crv_19)
gradient_3 = Gradient(
    LowerLimit=extremums_2.Minimum,
    UpperLimit=extremums_2.Maximum,
    Parameter=len_4,
    stops=[0: RGB(102, 255, 224), 0.116: RGB(64, 184, 146), 0.267: RGB(57, 181, 230), 0.547: RGB(91, 62, 181), 0.791: RGB(179, 0, 255)])
split_multi = SplitListMulti(List=ins, Index=num_3)
gradient_4 = Gradient(
    LowerLimit=extremums_2.Minimum,
    UpperLimit=extremums_2.Maximum,
    Parameter=len_5,
    stops=[0: RGB(102, 255, 224), 0.116: RGB(64, 184, 146), 0.267: RGB(57, 181, 230), 0.547: RGB(91, 62, 181), 0.791: RGB(179, 0, 255)])
join_t_3 = JoinCurvesWithTolerance(Curves=split_multi, Tolerance=Slider(13, range=0..29), Option=0)
reb_2 = RebuildCurve(Curve=join_t_3, Count=Slider(20, range=0..100), Tangents=False)
col_4 = Colour(RGB(179, 0, 255))
previewlw_15 = CustomPreviewLineweights(Geometry=crv_19, Shader=gradient_4, Thickness=Slider(3, range=0..10), Absolute=False)
previewlw_16 = CustomPreviewLineweights(Geometry=item_33, Shader=gradient_3, Thickness=Slider(3, range=0..10), Absolute=False)
previewlw_17 = CustomPreviewLineweights(Geometry=reb_2, Shader=ColourSwatch(SwatchColor=RGB(148, 248, 255)), Thickness=Slider(4, range=0..10), Absolute=False)
previewlw_18 = CustomPreviewLineweights(Geometry=item_32, Shader=col_4, Thickness=Slider(6, range=0..10), Absolute=False)

split_5 = SplitTree(Data=loop_start.Data_2, Masks=flatten(expression))  # -> Positive, Negative
renumber = RenumberPaths(Data=split_5.Negative)

# ---- group: Target curve segment
item_35 = ListItem(List=shatter_3, Index="1", Wrap=True)

# ----
cull_i_5 = CullIndex(List=loop_start.Data_4, Indices=subtraction, Wrap=True)
null_3 = NullItem(Item=item_29)  # -> NullFlags, InvalidFlags, Description
filter_8 = StreamFilter(Gate=null_3.NullFlags, Stream0=cull_i_5, Stream1=loop_start.Data_4)
filter_9 = StreamFilter(Gate=null_3.NullFlags, Stream0=renumber, Stream1=loop_start.Data_2)

# ---- group: Opposite edge for next target curve
flip = FlipCurve(Curve=ext)  # -> flatten(Curve), Flag

# ----
clean_7 = CleanTree(RemoveNulls=True, RemoveInvalid=True, RemoveEmpty=False, Tree=contour)
merge_5 = Merge(Data1=clean_3, Data2=null_3.NullFlags)  # -> flatten(Result)
merge_6 = Merge(Data1=clean_2, Data2=item_29)  # -> flatten(Result)
merge_7 = Merge(Data1=clean_7, Data2=item_30)  # -> flatten(Result)
merge_8 = Merge(Data1=clean, Data2=flip.Curve)  # -> flatten(Result)
loop_end = LoopEnd(
    port=loop_start.port,
    Exit=False,
    UserFirstTargetCurve=item_35,
    OffcutCurves=filter_9,
    SelectedOffcuts=merge_6,
    NullCheckNextTarget=null_3.NullFlags,
    Data=addition_3,
    Data_2=filter_8,
    SelectedContour=merge_7,
    RightCurve=merge_8,
    Data_3=merge_5,
    _180CHECK=larger.OrEqualTo,
    Data_4=filter_2,
    Data_5=bool,
    TimeOutVal=0,
    pausedState=False,
    state="Output last")  # -> simplify(Target), Offcut, Selected, D3, D4, D5, D6, D7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
crv_20 = Curve(flatten(loop_end.Selected))
crv_21 = Curve(loop_end.D6)
crv_22 = Curve(flatten(loop_end.D7))
item_36 = ListItem(List=crv_21, Index=Slider(0, range=0..100), Wrap=True)
clean_8 = CleanTree(RemoveNulls=True, RemoveInvalid=True, RemoveEmpty=False, Tree=crv_21)
cull_i_6 = CullIndex(List=loop_end.D6, Indices="-1", Wrap=True)
cluster = Cluster(crv=cull_i_6, bool=loop_end.D8)
cluster_2 = Cluster_2(C=cull_i_6, C_2=crv_20)
explode_6 = Explode(Curve=clean_8, Recursive=True)  # -> Segments, Vertices
flip_2 = FlipMatrix(Data=cluster)
item_37 = ListItem(List=explode_6.Segments, Index=Slider(1, range=0..3), Wrap=True)
randcol = RandomColor(Data=clean_8, Seed=2, FastMode=False)
item_38 = ListItem(List=flip_2, Index=number_slider_5, Wrap=True)  # -> simplify(Item)
branch = TreeBranch(Tree=simplify(flip_2), Path=number_slider_5, MaintainPaths=True)
len_6 = Length(Curve=flatten(item_37))
partition_6 = PartitionList(List=cluster, Size="3")
mindex_2 = MemberIndex(Set=len_3, Member=len_6)  # -> flatten(Index), Count
previewlw_19 = CustomPreviewLineweights(Geometry=branch, Shader=ColourSwatch(SwatchColor=RGB(0, 255, 213)), Thickness=Slider(7, range=0..10), Absolute=False)
center_7 = Center(Geometric=clean_8)  # -> flatten(Center), Dimension
item_39 = ListItem(List=center_6.Center, Index=mindex_2.Index, Wrap=True)
tag_4 = TextTag(Location=item_39, Text=mindex_2.Index, Colour=randcol)
tag_5 = TextTag(Location=center_7.Center, Text=mindex_2.Index, Colour=randcol)

# ==== cluster Cluster
bool = ClusterInput()
bool_2 = Boolean(bool)
mindex = MemberIndex(Set=bool_2, Member=Toggle(True))  # -> simplify(Index), Count
cull_i = CullIndex(List=mindex.Index, Indices="0", Wrap=True)
item = ListItem(List=mindex.Index, Index="0", Wrap=True)
lng = ListLength(List=cull_i)
crv = ClusterInput()
series = Series(Start="1", Step=1, Count=lng)
subtraction = Subtraction(A=cull_i, B=series)
crv_2 = Curve(flatten(crv))
ins = InsertItems(List=subtraction, Item=item, Indices="0", Wrap=True)
shift = ShiftList(List=ins, Shift=1, Wrap=True)  # -> simplify(graft(List))
graft = GraftTree(Tree=ins, IncludeEmptyLists=True, IncludeNullItems=True)  # -> simplify(Tree)
subtraction_2 = Subtraction(A=shift, B=graft)  # -> flatten(Result)
x_minus_one = XMinusOne(NumberX=mindex.Index)
cull_i_2 = CullIndex(List=subtraction_2, Indices="-1", Wrap=True)
clean = CleanTree(RemoveNulls=True, RemoveInvalid=True, RemoveEmpty=False, Tree=crv_2)
ma = MassAddition(Input=cull_i_2)  # -> Result, PartialResults
lng_2 = ListLength(List=clean)
subtraction_3 = Subtraction(A=lng_2, B=ma.Result)
ins_2 = InsertItems(List=cull_i_2, Item=subtraction_3, Indices="-1", Wrap=True)
partition = PartitionList(List=clean, Size=ins_2)
split_multi = SplitListMulti(List=crv_2, Index=ins)
C = ClusterOutput(split_multi)

# ==== cluster Cluster_2
C = ClusterInput()
C_2 = ClusterInput()
join_t = JoinCurvesWithTolerance(Curves=C, Tolerance="12", Option=0)
join = JoinCurves(Curves=C_2, Preserve=False)
X = UnitX(Factor=Slider(20, range=0..100))
num = Number()
move = Move(Geometry=join_t, Motion=X)  # -> Geometry, Transform
item = ListItem(List=join, Index="1", Wrap=True)
item_2 = ListItem(List=move.Geometry, Index=0, Wrap=True)
number_slider = Slider(30, range=0..100)
end = EndPoints(Curve=item)  # -> Start, End
tweencrv = TweenCurve(CurveA=item_2, CurveB=item, Factor=Slider(0.61, range=0..1), BlendType=0)
Y = UnitY(Factor=1)
contour = Contour(Curve=[item_2, item], Point=end.Start, Direction=Y, Distance=Slider(5, range=0..20))  # -> simplify(Contours), Parameters
trim = TrimTree(Tree=contour.Contours, Depth=1)
previewlw = CustomPreviewLineweights(
    Geometry=move.Geometry,
    Shader=ColourSwatch(SwatchColor=RGB(0, 221, 255)),
    Thickness=Slider(4, range=0..10),
    Absolute=False)
previewlw_2 = CustomPreviewLineweights(Geometry=join, Shader=ColourSwatch(SwatchColor=RGB(255, 0, 0)), Thickness=Slider(10, range=0..10), Absolute=False)
branch = TreeBranch(Tree=trim, Path="0", MaintainPaths=True)
branch_2 = TreeBranch(Tree=trim, Path="1", MaintainPaths=True)
ln = Line(StartPoint=branch, EndPoint=branch_2)
len = Length(Curve=ln)
larger = LargerThan(FirstNumber=len, SecondNumber="5")  # -> LargerThan, OrEqualTo
dispatch = Dispatch(List=ln, DispatchPattern=larger.LargerThan)  # -> ListA, ListB
midpt = CurveMiddle(Curve=dispatch.ListB)
pline = PolyLine(Vertices=midpt, Closed=False)
intcrv = Interpolate(Vertices=midpt, Degree=3, Periodic=False, KnotStyle=1)  # -> Curve, Length, Domain
previewlw_3 = CustomPreviewLineweights(
    Geometry=intcrv.Curve,
    Shader=ColourSwatch(SwatchColor=RGB(98, 255, 84)),
    Thickness=Slider(2, range=0..10),
    Absolute=False)
